# Grasshopper definition Vector Angle_nonworking.gh (Grasshopper 1.0.5)

pln = Plane(flatten([PlaneXY(0, 0, 0), Plane(origin=(7.398497806, 0, 0), x=(0, 1, 0), y=(-1, 0, 0)), Plane(origin=(14.79699561, 0, 0), x=(-1, 0, 0), y=(0, -1, 0)), Plane(origin=(22.19549342, 0, 0), x=(0, -1, 0), y=(1, 0, 0))]))
X = UnitX(Factor=1)
deplane = DeconstructPlane(Plane=pln)  # -> Origin, XAxis, YAxis, ZAxis
angle = Angle(VectorA=X, VectorB=deplane.XAxis)  # -> Angle, Reflex
points = PointList(Points=deplane.Origin, Size=1)
deg = Degrees(Radians=angle.Angle)
panel = Panel(deg)
