# Grasshopper definition dbl_iso_based_PY.gh (Grasshopper 1.0.7)

# ---- group: make 3 curves
half_height = Slider(35, range=20..200)
radius_1 = Slider(88, range=20..200)
plane = Plane(PlaneXY(0, 0, 0))
ellipse = Ellipse(Plane=plane, Radius1=radius_1, Radius2=Slider(36, range=20..200))  # -> Ellipse, Focus1, Focus2
vec = VectorXYZ(XComponent=Slider(0.154, range=0..1), YComponent=Slider(0, range=0..1), ZComponent=half_height)  # -> Vector, Length
_3 = Integer(3)
curve_height = Slider(25, range=20..200)
arrlinear = LinearArray(Geometry=ellipse.Ellipse, Direction=vec.Vector, Count=_3)  # -> Geometry, Transform
integer = Integer([0, 2])
_4 = Integer(4)
cull_i = CullIndex(List=arrlinear.Geometry, Indices=integer, Wrap=True)
divide = DivideCurve(Curve=cull_i, Count=_4, Kinks=False)  # -> Points, Tangents, Parameters
integer_2 = Integer([1, 3])
vec_2 = VectorXYZ(XComponent=Slider(0, range=0..1), YComponent=Slider(0, range=0..1), ZComponent=curve_height)  # -> Vector, Length
integer_3 = Integer([0, 2])
cull_i_2 = CullIndex(List=divide.Points, Indices=integer_3, Wrap=True)
cull_i_3 = CullIndex(List=divide.Points, Indices=integer_2, Wrap=True)
move = Move(Geometry=cull_i_2, Motion=vec_2.Vector)  # -> Geometry, Transform
integer_4 = Integer(-2)
weave = Weave(Pattern=[0, 1], Stream0=cull_i_3, Stream1=move.Geometry, NullGaps=False)
division = Division(A=curve_height, B=integer_4)
integer_5 = Integer([1, 2])
integer_6 = Integer([0, 1])
intcrv = Interpolate(Vertices=weave, Degree=3, Periodic=True, KnotStyle=1)  # -> Curve, Length, Domain
Z = UnitZ(Factor=division)
cull_i_4 = CullIndex(List=arrlinear.Geometry, Indices=integer_6, Wrap=True)
cull_i_5 = CullIndex(List=arrlinear.Geometry, Indices=integer_5, Wrap=True)
move_2 = Move(Geometry=intcrv.Curve, Motion=Z)  # -> Geometry, Transform

# ----
area = Area(Geometry=ellipse.Ellipse)  # -> Area, Centroid
weave_2 = Weave(Pattern=[0, 1], Stream0=move_2.Geometry, Stream1=cull_i_5, NullGaps=False)
weave_3 = Weave(Pattern=[0, 1], Stream0=cull_i_4, Stream1=move_2.Geometry, NullGaps=False)
curve_points = Slider(100, range=20..200)
layer_height = Number(2.15)

# ---- group: isocurves
loft = Loft(Curves=weave_2, Options={Adjust=False, Closed=False, LoftEnds=0, LoftSimp=2, LoftType=0, Rebuild=10, Refit=0.01})
bbox_size_of_object = BoundingBox(Content=weave_2, Plane=PlaneXY(0, 0, 0))  # -> Box, Box_2
debox = DeconstructBox(Box=bbox_size_of_object.Box)  # -> Plane, X, Y, Z
dedomain = DeconstructDomain(Domain=debox.Z)  # -> Start, End
division_2 = Division(A=dedomain.End, B=layer_height)
range = Range(Domain=Domain(0, 1), Steps=division_2)
pt = ConstructPoint(XCoordinate=range, YCoordinate=0, ZCoordinate=0)
iso = IsoCurve(Surface=reparameterize(loft), UVPoint=pt)  # -> UIsocurve, flatten(VIsocurve)
rev = ReverseList(List=iso.VIsocurve)

# ----
loft_2 = Loft(Curves=weave_3, Options={Adjust=False, Closed=False, LoftEnds=0, LoftSimp=2, LoftType=0, Rebuild=10, Refit=0.01})
bbox_size_of_object_2 = BoundingBox(Content=weave_3, Plane=PlaneXY(0, 0, 0))  # -> Box, Box_2
debox_2 = DeconstructBox(Box=bbox_size_of_object_2.Box)  # -> Plane, X, Y, Z
dedomain_2 = DeconstructDomain(Domain=debox_2.Z)  # -> Start, End
cull_i_6 = CullIndex(List=dedomain_2.End, Indices=1, Wrap=True)
division_3 = Division(A=cull_i_6, B=layer_height)
range_2 = Range(Domain=Domain(0, 1), Steps=division_3)
pt_2 = ConstructPoint(XCoordinate=range_2, YCoordinate=0, ZCoordinate=0)
iso_2 = IsoCurve(Surface=reparameterize(loft_2), UVPoint=pt_2)  # -> UIsocurve, flatten(VIsocurve)
rev_2 = ReverseList(List=iso_2.VIsocurve)

_200 = Integer(200)
num = Number(1.6)
addition = Addition(A=num, B=num)
addition_2 = Addition(A=addition, B=layer_height)
vec_3 = VectorXYZ(XComponent=_200, YComponent=_200, ZComponent=addition_2)  # -> Vector, Length
move_up_and_to_cartesian = Move(Geometry=rev, Motion=vec_3.Vector)  # -> Geometry, Transform
move_up_and_to_cartesian_2 = Move(Geometry=rev_2, Motion=vec_3.Vector)  # -> Geometry, Transform
angle = Angle()  # -> Angle, Reflex
divide_2 = DivideCurve(Curve=move_up_and_to_cartesian.Geometry, Count=curve_points, Kinks=False)  # -> Points, flatten(Tangents), Parameters
vec_4 = VectorXYZ(XComponent=_200, YComponent=_200, ZComponent=addition)  # -> Vector, Length
vec_5 = VectorXYZ(XComponent=_200, YComponent=_200, ZComponent=num)  # -> Vector, Length
divide_3 = DivideCurve(Curve=move_up_and_to_cartesian_2.Geometry, Count=curve_points, Kinks=False)  # -> Points, flatten(Tangents), Parameters
divisor = Slider(10, range=0..11)
remap_factor = Slider(0.75, range=0.1..2)

flip = FlipMatrix(Data=divide_3.Points)
explode = Explode(Curve=move_up_and_to_cartesian_2.Geometry, Recursive=True)  # -> Segments, Vertices
pline = PolyLine(Vertices=flip, Closed=False)
end = EndPoints(Curve=pline)  # -> Start, End
vec2pt = Vector2Pt(PointA=end.Start, PointB=end.End, Unitize=False)  # -> Vector, Length
flip_2 = FlipMatrix(Data=vec2pt.Vector)
len = Length(Curve=explode.Segments)
vlen = VectorLength(Vector=flip_2)
cull_i_7 = CullIndex(List=flatten(vlen), Indices=1, Wrap=True)
bnd = Bounds(Numbers=cull_i_7)
remap = RemapNumbers(Value=cull_i_7, Source=bnd, Target=remap_factor)  # -> Mapped, Clipped
division_4 = Division(A=len, B=divisor)
multiplication = Multiplication(A=division_4, B=remap.Mapped)
ma = MassAddition(Input=multiplication)  # -> Result, PartialResults

flip_3 = FlipMatrix(Data=divide_2.Points)
explode_2 = Explode(Curve=move_up_and_to_cartesian.Geometry, Recursive=True)  # -> Segments, Vertices
pline_2 = PolyLine(Vertices=flip_3, Closed=False)
end_2 = EndPoints(Curve=pline_2)  # -> Start, End
vec2pt_2 = Vector2Pt(PointA=end_2.Start, PointB=end_2.End, Unitize=False)  # -> Vector, Length
flip_4 = FlipMatrix(Data=vec2pt_2.Vector)
len_2 = Length(Curve=explode_2.Segments)
vlen_2 = VectorLength(Vector=flip_4)
cull_i_8 = CullIndex(List=flatten(vlen_2), Indices=1, Wrap=True)
bnd_2 = Bounds(Numbers=cull_i_8)
division_5 = Division(A=len_2, B=divisor)
remap_2 = RemapNumbers(Value=cull_i_8, Source=bnd_2, Target=remap_factor)  # -> Mapped, Clipped
multiplication_2 = Multiplication(A=division_5, B=remap_2.Mapped)
ma_2 = MassAddition(Input=multiplication_2)  # -> Result, PartialResults

extrusion_multiplier = Slider(1.75, range=0..5)
shift_list = ShiftList(List=divide_3.Points, Shift=1, Wrap=True)
length_of_segment = Distance(PointA=divide_3.Points, PointB=shift_list)  # -> flatten(SegmentLength)
list_length = ListLength(List=length_of_segment)
ghpython_script = GhPythonScript(x=length_of_segment, y=list_length)  # -> out, a; inputs x: list, y: Int32
# ---------- ghpython_script: Python ----------
__author__ = "morr0289"
__version__ = "2023.07.05"

import rhinoscriptsyntax as rs
import math
x = []
a = []
z = 0
for y in x: 
    roundIt = str(round(x,2)
    z = (roundIt * 100)
    hex = hex(z)
    a.append(hex)
# ---------- end ghpython_script ----------

gcode_formatter = Expression(
    e=ma.PartialResults,
    Expression="Format(\"code, ret = arm.getset_tgpio_modbus_data([0x08, 0x10, 0x01, 0x00, 0x00, 0x04, 0x08, 0x0, 0x2, 0x0, 0x0])\", x, y, z, e)")  # -> flatten(Result)
# modbus call: while arm.connected and arm.error_code == 0:
lng = ListLength(List=flatten(len))
series = Series(Start=curve_points, Step=curve_points, Count=lng)
ins = InsertItems(List=gcode_formatter, Indices=flatten(series), Wrap=False)
object_code = Panel(ins)

panel = Panel(ghpython_script.out)

deconstruct = Deconstruct(Point=divide_3.Points)  # -> XComponent, YComponent, ZComponent
gcode_formatter_2 = Expression(
    e=ma.PartialResults,
    x=deconstruct.XComponent,
    y=deconstruct.YComponent,
    z=deconstruct.ZComponent,
    Expression="Format(\"G1 X{0:0.00} Y{1:0.00} Z{2:0.00} E{3:0.00}\", x, y, z, e)")  # -> flatten(Result)
lng_2 = ListLength(List=flatten(len))
series_2 = Series(Start=curve_points, Step=curve_points, Count=lng_2)
ins_2 = InsertItems(List=gcode_formatter_2, Item="G92 E0;*****************", Indices=flatten(series_2), Wrap=False)
object_code_2 = Panel(ins_2)

int = Integer(0)
robot_header = Panel("""import os
import sys
import time

sys.path.append(os.path.join(os.path.dirname(__file__), '../../..'))

from xarm.wrapper import XArmAPI

if len(sys.argv) >= 2:
    ip = sys.argv[1]
else:
    try:
        from configparser import ConfigParser
        parser = ConfigParser()
        parser.read('../robot.conf')
        ip = parser.get('xArm', 'ip')
    except:
        ip = input('Please input the xArm ip address:')
        if not ip:
            print('input error, exit')
            sys.exit(1)



arm = XArmAPI(ip)
arm.motion_enable(enable=True)
arm.set_mode(0)
arm.set_state(state=0)

code = arm.set_tgpio_modbus_baudrate(115200)
print('set_tgpio_modbus_baudrate, code={}'.format(code))
time.sleep(2)""")
potterbot_footer = Panel("""M83 ;Set to Relative Extrusion Mode
G91 ;Set to Relative Positioning
G1 Z150 E-4000 F66666 ;Move Z Axis up and depressurize Extruder slightly
G90 ;Set to Absolute Positioning
G28 Z ;Home Z
G1 X0 Y0 F500 ;Move X and Y slow to home position
M82 ;absolute extrusion mode
;End of Gcode""")

extrusion_width = Slider(2.55, range=1..5)
crv_cp = CurveClosestPoint(Point=area.Centroid, Curve=ellipse.Ellipse)  # -> Point, Parameter, Distance
division_6 = Division(A=crv_cp.Distance, B=extrusion_width)
_40 = Integer(40)
range_3 = Range(Domain=Domain(0, 1), Steps=expr("X-1", _40))

# ---- group: contour base
X = UnitX(Factor=1)
contour = Contour(Shape=ellipse.Ellipse, Point=Point(0, 0, 0), Direction=X, Distance=extrusion_width)
dispatch = Dispatch(List=flatten(contour), DispatchPattern=[True, False])  # -> ListA, ListB
flip_5 = FlipCurve(Curve=dispatch.ListB)  # -> Curve, Flag
weave_4 = Weave(Pattern=[0, 1], Stream0=dispatch.ListA, Stream1=flip_5.Curve, NullGaps=False)
disc = Discontinuity(Curve=weave_4, Level=1)  # -> Points, Parameters
pline_3 = PolyLine(Vertices=flatten(disc.Points), Closed=False)

# ----
neg = Negative(Value=extrusion_width)

series_3 = Series(Start=0, Step=neg, Count=division_6)
offset = OffsetCurve(Curve=ellipse.Ellipse, Distance=series_3, Plane=PlaneXY(0, 0, 0), Corners=2)
divide_4 = DivideCurve(Curve=offset, Count=_40, Kinks=False)  # -> Points, Tangents, Parameters
flip_6 = FlipMatrix(Data=divide_4.Points)
pline_4 = PolyLine(Vertices=flip_6, Closed=False)
explode_3 = Explode(Curve=pline_4, Recursive=True)  # -> Segments, Vertices
end_3 = EndPoints(Curve=explode_3.Segments)  # -> Start, End
vec2pt_3 = Vector2Pt(PointA=end_3.Start, PointB=end_3.End, Unitize=False)  # -> Vector, Length
flip_7 = FlipMatrix(Data=vec2pt_3.Vector)
multiplication_3 = Multiplication(A=flip_7, B=range_3)
move_3 = Move(Geometry=divide_4.Points, Motion=multiplication_3)  # -> Geometry, Transform
pline_5 = PolyLine(Vertices=flatten(move_3.Geometry), Closed=False)

move_up_and_to_cartesian_3 = Move(Geometry=pline_5, Motion=vec_4.Vector)  # -> Geometry, Transform
move_up_and_to_cartesian_4 = Move(Geometry=pline_3, Motion=vec_5.Vector)  # -> Geometry, Transform

explode_4 = Explode(Curve=move_up_and_to_cartesian_4.Geometry, Recursive=False)  # -> Segments, Vertices
len_3 = Length(Curve=explode_4.Segments)
multiplication_4 = Multiplication(A=len_3, B=extrusion_multiplier)
ma_3 = MassAddition(Input=multiplication_4)  # -> Result, PartialResults

explode_5 = Explode(Curve=move_up_and_to_cartesian_3.Geometry, Recursive=True)  # -> Segments, Vertices
len_4 = Length(Curve=explode_5.Segments)
multiplication_5 = Multiplication(A=len_4, B=extrusion_multiplier)
# 1001_move_line.py: #!/usr/bin/env python3
# # Software License Agreement (BSD License)
# #
# # Copyright (c) 2019, UFACTORY, Inc.
# # All rights reserved.
# #
# # Author: Vinman <vinman.wen@ufactory.cc> <vinman.cub@gmail.com>
# 
# """
# Description: Move line(linear motion)
# """
# 
# import os
# import sys
# import time
# 
# sys.path.append(os.path.join(os.path.dirname(__file__), '../../..'))
# 
# from xarm.wrapper import XArmAPI
# 
# 
# #######################################################
# """
# Just for test example
# """
# if len(sys.argv) >= 2:
#     ip = sys.argv[1]
# else:
#     try:
#         from configparser import ConfigParser
#         parser = ConfigParser()
#         parser.read('../robot.conf')
#         ip = parser.get('xArm', 'ip')
#     except:
#         ip = input('Please input the xArm ip address:')
#         if not ip:
#             print('input error, exit')
#             sys.exit(1)
# ########################################################
# 
# 
# arm = XArmAPI(ip)
# arm.motion_enable(enable=True)
# arm.set_mode(0)
# arm.set_state(state=0)
# 
# arm.reset(wait=True)
# 
# arm.set_position(x=300, y=0, z=150, roll=-180, pitch=0, yaw=0, speed=100, wait=True)
# print(arm.get_position(), arm.get_position(is_radian=True))
# arm.set_position(x=300, y=200, z=250, roll=-180, pitch=0, yaw=0, speed=200, wait=True)
# print(arm.get_position(), arm.get_position(is_radian=True))
# arm.set_position(x=500, y=200, z=150, roll=-180, pitch=0, yaw=0, speed=300, wait=True)
# print(arm.get_position(), arm.get_position(is_radian=True))
# arm.set_position(x=500, y=-200, z=250, roll=-180, pitch=0, yaw=0, speed=400, wait=True)
# print(arm.get_position(), arm.get_position(is_radian=True))
# arm.set_position(x=300, y=-200, z=150, roll=-180, pitch=0, yaw=0, speed=500, wait=True)
# print(arm.get_position(), arm.get_position(is_radian=True))
# arm.set_position(x=300, y=0, z=250, roll=-180, pitch=0, yaw=0, speed=600, wait=True)
# print(arm.get_position(), arm.get_position(is_radian=True))
# 
# 
# arm.reset(wait=True)
# 
# arm.set_position(x=300, y=0, z=150, roll=-3.1415926, pitch=0, yaw=0, speed=100, is_radian=True, wait=True)
# print(arm.get_position(), arm.get_position(is_radian=True))
# arm.set_position(x=300, y=200, z=250, roll=-3.1415926, pitch=0, yaw=0, speed=200, is_radian=True, wait=True)
# print(arm.get_position(), arm.get_position(is_radian=True))
# arm.set_position(x=500, y=200, z=150, roll=-3.1415926, pitch=0, yaw=0, speed=300, is_radian=True, wait=True)
# print(arm.get_position(), arm.get_position(is_radian=True))
# arm.set_position(x=500, y=-200, z=250, roll=-3.1415926, pitch=0, yaw=0, speed=400, is_radian=True, wait=True)
# print(arm.get_position(), arm.get_position(is_radian=True))
# arm.set_position(x=300, y=-200, z=150, roll=-3.1415926, pitch=0, yaw=0, speed=500, is_radian=True, wait=True)
# print(arm.get_position(), arm.get_position(is_radian=True))
# arm.set_position(x=300, y=0, z=250, roll=-3.1415926, pitch=0, yaw=0, speed=600, is_radian=True, wait=True)
# print(arm.get_position(), arm.get_position(is_radian=True))
# 
# arm.reset(wait=True)
# arm.disconnect()
# 1002_move_line_py: #!/usr/bin/env python3
# # Software License Agreement (BSD License)
# #
# # Copyright (c) 2019, UFACTORY, Inc.
# # All rights reserved.
# #
# # Author: Vinman <vinman.wen@ufactory.cc> <vinman.cub@gmail.com>
# 
# """
# Description: Move line(linear motion)
# """
# 
# import os
# import sys
# import time
# 
# sys.path.append(os.path.join(os.path.dirname(__file__), '../../..'))
# 
# from xarm.wrapper import XArmAPI
# 
# 
# #######################################################
# """
# Just for test example
# """
# if len(sys.argv) >= 2:
#     ip = sys.argv[1]
# else:
#     try:
#         from configparser import ConfigParser
#         parser = ConfigParser()
#         parser.read('../robot.conf')
#         ip = parser.get('xArm', 'ip')
#     except:
#         ip = input('Please input the xArm ip address:')
#         if not ip:
#             print('input error, exit')
#             sys.exit(1)
# ########################################################
# 
# 
# arm = XArmAPI(ip, is_radian=True)
# arm.motion_enable(enable=True)
# arm.set_mode(0)
# arm.set_state(state=0)
# 
# arm.reset(wait=True)
# 
# arm.set_position(x=300, y=0, z=150, roll=-180, pitch=0, yaw=0, speed=100, is_radian=False, wait=True)
# print(arm.get_position(), arm.get_position(is_radian=False))
# arm.set_position(x=300, y=200, z=250, roll=-180, pitch=0, yaw=0, speed=200, is_radian=False, wait=True)
# print(arm.get_position(), arm.get_position(is_radian=False))
# arm.set_position(x=500, y=200, z=150, roll=-180, pitch=0, yaw=0, speed=300, is_radian=False, wait=True)
# print(arm.get_position(), arm.get_position(is_radian=False))
# arm.set_position(x=500, y=-200, z=250, roll=-180, pitch=0, yaw=0, speed=400, is_radian=False, wait=True)
# print(arm.get_position(), arm.get_position(is_radian=False))
# arm.set_position(x=300, y=-200, z=150, roll=-180, pitch=0, yaw=0, speed=500, is_radian=False, wait=True)
# print(arm.get_position(), arm.get_position(is_radian=False))
# arm.set_position(x=300, y=0, z=250, roll=-180, pitch=0, yaw=0, speed=600, is_radian=False, wait=True)
# print(arm.get_position(), arm.get_position(is_radian=False))
# 
# 
# arm.reset(wait=True)
# 
# arm.set_position(x=300, y=0, z=150, roll=-3.1415926, pitch=0, yaw=0, speed=100, wait=True)
# print(arm.get_position(), arm.get_position(is_radian=False))
# arm.set_position(x=300, y=200, z=250, roll=-3.1415926, pitch=0, yaw=0, speed=200, wait=True)
# print(arm.get_position(), arm.get_position(is_radian=False))
# arm.set_position(x=500, y=200, z=150, roll=-3.1415926, pitch=0, yaw=0, speed=300, wait=True)
# print(arm.get_position(), arm.get_position(is_radian=False))
# arm.set_position(x=500, y=-200, z=250, roll=-3.1415926, pitch=0, yaw=0, speed=400, wait=True)
# print(arm.get_position(), arm.get_position(is_radian=False))
# arm.set_position(x=300, y=-200, z=150, roll=-3.1415926, pitch=0, yaw=0, speed=500, wait=True)
# print(arm.get_position(), arm.get_position(is_radian=False))
# arm.set_position(x=300, y=0, z=250, roll=-3.1415926, pitch=0, yaw=0, speed=600, wait=True)
# print(arm.get_position(), arm.get_position(is_radian=False))
# 
# arm.reset(wait=True)
# arm.disconnect()
ma_4 = MassAddition(Input=multiplication_5)  # -> Result, PartialResults

deconstruct_2 = Deconstruct(Point=explode_5.Vertices)  # -> XComponent, YComponent, ZComponent
gcode_formatter_3 = Expression(
    e=ma_4.PartialResults,
    x=deconstruct_2.XComponent,
    y=deconstruct_2.YComponent,
    z=deconstruct_2.ZComponent,
    Expression="Format(\"G1 X{0:0.00} Y{1:0.00} Z{2:0.00} E{3:0.00}\", x, y, z, e)")  # -> flatten(Result)

ins_3 = InsertItems(List=gcode_formatter_3, Item="G92 E0;************************", Indices=0, Wrap=True)

base_2_code = Panel(ins_3)

deconstruct_3 = Deconstruct(Point=divide_2.Points)  # -> XComponent, YComponent, ZComponent
lng_3 = ListLength(List=flatten(len_2))
gcode_formatter_4 = Expression(
    e=ma_2.PartialResults,
    x=deconstruct_3.XComponent,
    y=deconstruct_3.YComponent,
    z=deconstruct_3.ZComponent,
    Expression="Format(\"G1 X{0:0.00} Y{1:0.00} Z{2:0.00} E{3:0.00}\", x, y, z, e)")  # -> flatten(Result)
series_4 = Series(Start=curve_points, Step=curve_points, Count=lng_3)

ins_4 = InsertItems(List=series_4, Item=int, Indices=0, Wrap=True)

ins_5 = InsertItems(List=gcode_formatter_4, Item="G92 E0;***************", Indices=flatten(ins_4), Wrap=False)
object_code_3 = Panel(ins_5)

deconstruct_4 = Deconstruct(Point=explode_4.Vertices)  # -> XComponent, YComponent, ZComponent
gcode_formatter_5 = Expression(
    e=ma_3.PartialResults,
    x=deconstruct_4.XComponent,
    y=deconstruct_4.YComponent,
    z=deconstruct_4.ZComponent,
    Expression="Format(\"G1 X{0:0.00} Y{1:0.00} Z{2:0.00} E{3:0.00}\", x, y, z, e)")  # -> flatten(Result)

ins_6 = InsertItems(List=gcode_formatter_5, Item="G92 E0;*********************", Indices=0, Wrap=True)

base_1_code = Panel(ins_6)

merge = Merge(Data1=robot_header, Data2=base_1_code, Data3=base_2_code, Data4=object_code_3, Data5=object_code_2)  # -> flatten(Result)
merge_2 = Merge(Data1=merge, Data2=potterbot_footer)
panel_2 = Panel(merge_2)
