# Grasshopper definition txt_writer.gh (Grasshopper 1.0.7)

# The file will save to the directory where the GH file lives.
sample_g_code = Panel("""G17 G20 G90 G94 G54
G0 Z0.25
X-0.5 Y0.
Z0.1
G01 Z0. F5.
G02 X0. Y0.5 I0.5 J0. F2.5
X0.5 Y0. I0. J-0.5
X0. Y-0.5 I-0.5 J0.
X-0.5 Y0. I0. J0.5
G01 Z0.1 F5.
G00 X0. Y0. Z0.25""")
desired_file_extension = Panel("gcode")
file_name = Panel("my_gcode")
txt_writer = TextDocumentWriter()  # inputs relative: Boolean, lines: list, write: Boolean, overwrite: Boolean, append: Boolean
# ---------- txt_writer: Python ----------
"""
Writes to a TXT or CSV file.
    Inputs:
        relative: Set to 'True' to create a new Text File using relative path. This file will live in the same directory as the Grasshopper document.
        file: TXT or CSV file to write to.
        lines: Text to write.
        write: Set to True to write.
        overwrite: Set to True to overwrite the specified file.
        append: Set to True to append the specified file.
"""

# Stephen P. Maher /  2015

ghenv.Component.Name = "Text Document Writer"
ghenv.Component.NickName = 'TXT-Writer'

import Grasshopper as gh
import os

if not relative and not file:
    msg = "Set either 'relative' to True or connect a file path to input parameter 'file'."
    ghenv.Component.AddRuntimeMessage(gh.Kernel.GH_RuntimeMessageLevel.Warning, msg)
elif relative == True:
    if overwrite == True and append == True:
        msg = "Set either 'overwrite' or 'append' to True."
        ghenv.Component.AddRuntimeMessage(gh.Kernel.GH_RuntimeMessageLevel.Error, msg)
    elif write:
        gh_path = ghdoc.Path # Get GH document's file path
        name = gh_path.split(".")[0]
        new = name.split("\\")
        file_name = new[4] + "_text_file.txt" # Create text file name
        dir = os.path.dirname(os.path.realpath(gh_path))
        file = os.path.join(dir, file_name) # Create text file path
        filePath = open(file, "w") # Open text file to create it
        if os.stat(file).st_size == 0: # Check to see if file has any data and continue if it's empty
            filePath = open(file, "w") # Open the file
            for line in lines: # Iterate through lines
                filePath.write(line + "\n") # Write separate lines
            filePath.close() # Close the file
        elif os.stat(file).st_size >= 1 and overwrite == False and append == False: # Check if file has data; if it does and 'overwrite' is  set to False, warn the user
            msg = "This file has content. If you wish to overwrite or append the file, please set either input parameters 'overwrite' or 'append' to True."
            ghenv.Component.AddRuntimeMessage(gh.Kernel.GH_RuntimeMessageLevel.Error, msg)
        elif os.stat(file).st_size >= 1 and overwrite == True: # If file has data and 'overwrite' set to True continue
            filePath = open(file, "w") # Open the file
            for line in lines: # Iterate through lines
                filePath.write(line + "\n") # Write separate lines
            filePath.close() # Close the file
        elif os.stat(file).st_size >= 1 and append == True: # If file has data and 'append' set to True and 'overwrite set to False  continue
            filePath = open(file, "a") # Open the file and 'append' document
            for line in lines: # Iterate through lines
                filePath.write("\n" + line) # Write separate lines
            filePath.close() # Close the file
    else:
        msg = "Set 'write' to True."
        ghenv.Component.AddRuntimeMessage(gh.Kernel.GH_RuntimeMessageLevel.Warning, msg)
elif relative == False or not relative:
    open(file, "w")
    if file:
        if overwrite == True and append == True:
            msg = "Set either 'overwrite' or 'append' to True."
            ghenv.Component.AddRuntimeMessage(gh.Kernel.GH_RuntimeMessageLevel.Error, msg)
        elif write:
            if os.stat(file).st_size == 0: # Check to see if file has any data and continue if it's empty
                filePath = open(file, "w") # Open the file
                for line in lines: # Iterate through lines
                    filePath.write(line + "\n") # Write separate lines
                filePath.close() # Close the file
            elif os.stat(file).st_size >= 1 and overwrite == False and append == False: # Check if file has data; if it does and 'overwrite' is  set to False, warn the user
                msg = "This file has content. If you wish to overwrite or append the file, please set either input parameters 'overwrite' or 'append' to True."
                ghenv.Component.AddRuntimeMessage(gh.Kernel.GH_RuntimeMessageLevel.Error, msg)
            elif os.stat(file).st_size >= 1 and overwrite == True: # If file has data and 'overwrite' set to True continue
                filePath = open(file, "w") # Open the file
                for line in lines: # Iterate through lines
                    filePath.write(line + "\n") # Write separate lines
                filePath.close() # Close the file
            elif os.stat(file).st_size >= 1 and append == True: # If file has data and 'append' set to True and 'overwrite set to False  continue
                filePath = open(file, "a") # Open the file and 'append' document
                for line in lines: # Iterate through lines
                    filePath.write("\n" + line) # Write separate lines
                filePath.close() # Close the file
        else:
            msg = "Set 'write' to True."
            ghenv.Component.AddRuntimeMessage(gh.Kernel.GH_RuntimeMessageLevel.Warning, msg)
    else:
        msg = "Input parameter 'file' failed to collect data."
        ghenv.Component.AddRuntimeMessage(gh.Kernel.GH_RuntimeMessageLevel.Warning, msg)
# ---------- end txt_writer ----------
python = FileCreator(name=file_name, ext=desired_file_extension, lines=sample_g_code, write=Button())  # inputs lines: list, write: Boolean
# ---------- python: Python ----------
"""
Creates a file with a given ndame and extension.
    Inputs:
        name: Desired file name.
        ext: Desired file extension.
        lines: Text to write.
        write: Set to True to write.
"""

# Stephen P. Maher /  2015

ghenv.Component.Name = "File Creator"

import Grasshopper as gh
import os

gh_path = ghdoc.Path # Get GH file path
file = os.path.dirname(os.path.realpath(gh_path)) # Get GH file directory to save to

if "." not in ext: ext = "." + ext
else: pass

if os.path.exists(file) == False: # Test if file already exists; if it doesn't, proceed
    file = name + ext # Set file name and extension
if os.path.exists(file) == True: # If it does exists, follow the next steps
    file_count = len([f for f in os.walk(".").next()[2] if f[-4:] == ext]) # Find all files with the same extension
    file = name + "_" + str(file_count) + ext # Add the number to the new file name as a differentiator

if write:
    filePath = open(file, "w") # Open the file
    for line in lines: # Iterate through lines
        filePath.write(line + "\n") # Write separate lines
    filePath.close() # Close the file
else:
    msg = "Set 'write' to True."
    ghenv.Component.AddRuntimeMessage(gh.Kernel.GH_RuntimeMessageLevel.Warning, msg)
# ---------- end python ----------
