# Grasshopper definition xArm6core_db_.gh (Grasshopper 1.0.7)
# plug-ins: CORE.Toolbox.Grasshopper

# ----
# EXTRUSION WIDTH
extrusion_width = Slider(2.55, range=1..5)

# ----
# EXTRUDER ANGLE
extruder_angle = Slider(120, range=0..180)

# ----
# NUM CURVE POINTS
curve_points = Slider(20, range=20..200)

# ----
# X POSITION
_400 = Integer(400)

# ----
# ARM SPEED
speed = Number(150)

# ----
# Y POSITION
_0 = Integer(0)

# ----
# LAYER HEIGHT
number = Number(1.85)

# ---- group: make 3 curves
# MAKE 3 CURVES
radius_1 = Slider(131, range=20..200)
plane = Plane(PlaneXY(0, 0, 0))
half_height = Slider(60, range=20..200)
curve_height = Slider(25, range=20..200)
ellipse = Ellipse(Plane=plane, Radius1=radius_1, Radius2=Slider(60, range=20..200))  # -> Ellipse, Focus1, Focus2
vec = VectorXYZ(XComponent=Slider(0.541, range=0..1), YComponent=Slider(0, range=0..1), ZComponent=half_height)  # -> Vector, Length
_3 = Integer(3)
arrlinear = LinearArray(Geometry=ellipse.Ellipse, Direction=vec.Vector, Count=_3)  # -> Geometry, Transform
_4 = Integer(4)
integer = Integer([0, 2])
cull_i = CullIndex(List=arrlinear.Geometry, Indices=integer, Wrap=True)
divide = DivideCurve(Curve=cull_i, Count=_4, Kinks=False)  # -> Points, Tangents, Parameters
integer_2 = Integer([0, 2])
integer_3 = Integer([1, 3])
vec_2 = VectorXYZ(XComponent=Slider(0, range=0..1), YComponent=Slider(0, range=0..1), ZComponent=curve_height)  # -> Vector, Length
cull_i_2 = CullIndex(List=divide.Points, Indices=integer_3, Wrap=True)
cull_i_3 = CullIndex(List=divide.Points, Indices=integer_2, Wrap=True)
move = Move(Geometry=cull_i_3, Motion=vec_2.Vector)  # -> Geometry, Transform
integer_4 = Integer(-2)
weave = Weave(Pattern=[0, 1], Stream0=cull_i_2, Stream1=move.Geometry, NullGaps=False)
division = Division(A=curve_height, B=integer_4)
integer_5 = Integer([1, 2])
integer_6 = Integer([0, 1])
Z = UnitZ(Factor=division)
intcrv = Interpolate(Vertices=weave, Degree=3, Periodic=True, KnotStyle=1)  # -> Curve, Length, Domain
cull_i_4 = CullIndex(List=arrlinear.Geometry, Indices=integer_6, Wrap=True)
cull_i_5 = CullIndex(List=arrlinear.Geometry, Indices=integer_5, Wrap=True)
move_2 = Move(Geometry=intcrv.Curve, Motion=Z)  # -> Geometry, Transform
weave_2 = Weave(Pattern=[0, 1], Stream0=move_2.Geometry, Stream1=cull_i_5, NullGaps=False)
weave_3 = Weave(Pattern=[0, 1], Stream0=cull_i_4, Stream1=move_2.Geometry, NullGaps=False)

# ----
# AREA MULTIPLIER
area_mult = Slider(1, range=0.5..1.5)

# ----
# BASE SPEED
speed_2 = Integer(speed)

arm_mm_sec = Division(A=speed, B=60)
int = Integer(-180)

# ----
# BASE SPEED
speed_3 = Integer(speed)

roll = Number(int)

# ----
# NOZZLE RADIUS
_1 = Number(expr("x²*π", 1))

# ----
# STEPS PER ROTATION
_200 = Integer(200)

# ----
# BARREL AREA
number_2 = Number(75.39)  # "75.39"

# ----
# AUGER PITCH
_7 = Integer(7)

# ----
# NOZZLE RADIUS
_1_2 = Number(expr("x²*π", 1))

# ----
# STEPS PER ROTATION
_200_2 = Integer(200)

# ----
# BARREL AREA
number_3 = Number(75.39)  # "75.39"

# ----
# AUGER PITCH
_7_2 = Integer(7)

# ----
# BASE
division_2 = Division(A=extrusion_width, B=-2)
offset_curve = OffsetCurve(Curve=ellipse.Ellipse, Distance=division_2, Corners=1)
# CONSTRUCT FORM
area = Area(Geometry=offset_curve)  # -> Area, Centroid
crv_cp = CurveClosestPoint(Point=area.Centroid, Curve=offset_curve)  # -> Point, Parameter, Distance
neg = Negative(Value=extrusion_width)
division_3 = Division(A=crv_cp.Distance, B=extrusion_width)
series = Series(Start=0, Step=neg, Count=division_3)
_800 = Integer(200)
offset = OffsetCurve(Curve=offset_curve, Distance=series, Plane=PlaneXY(0, 0, 0), Corners=2)
divide_2 = DivideCurve(Curve=offset, Count=_800, Kinks=False)  # -> Points, Tangents, Parameters
flip = FlipMatrix(Data=divide_2.Points)
range = Range(Domain=Domain(0, 1), Steps=expr("X-1", _800))
pline = PolyLine(Vertices=flip, Closed=False)
explode = Explode(Curve=pline, Recursive=True)  # -> Segments, Vertices
end = EndPoints(Curve=explode.Segments)  # -> Start, End
vec2pt = Vector2Pt(PointA=end.Start, PointB=end.End, Unitize=False)  # -> Vector, Length
flip_2 = FlipMatrix(Data=vec2pt.Vector)
multiplication = Multiplication(A=flip_2, B=range)
move_3 = Move(Geometry=divide_2.Points, Motion=multiplication)  # -> flatten(Geometry), Transform
list_item = ListItem(List=move_3.Geometry, Index=0, Wrap=True)
addition = Addition(A=number, B=number)
reverse_list = ReverseList(List=move_3.Geometry)
unit_z = UnitZ(Factor=addition)
unit_z_2 = UnitZ(Factor=number)
pline_2 = PolyLine(Vertices=reverse_list, Closed=False)
move_4 = Move(Geometry=pline_2, Motion=unit_z)  # -> Geometry, Transform

# ---- group: contour base
# parallel base layer
X = UnitX(Factor=1)
contour = Contour(Shape=offset_curve, Point=Point(0, 0, 0), Direction=X, Distance=extrusion_width)
dispatch = Dispatch(List=flatten(contour), DispatchPattern=[True, False])  # -> ListA, ListB
flip_3 = FlipCurve(Curve=dispatch.ListB)  # -> Curve, Flag
weave_4 = Weave(Pattern=[0, 1], Stream0=dispatch.ListA, Stream1=flip_3.Curve, NullGaps=False)
disc = Discontinuity(Curve=weave_4, Level=1)  # -> Points, Parameters

# ----
closest_point = ClosestPoint(Point=list_item, Cloud=flatten(disc.Points))  # -> ClosestPoint, CPIndex, Distance
shift_list = ShiftList(List=disc.Points, Shift=closest_point.CPIndex, Wrap=True)  # -> flatten(List)
pline_3 = PolyLine(Vertices=shift_list, Closed=False)
move_5 = Move(Geometry=pline_3, Motion=unit_z_2)  # -> Geometry, Transform
merge = Merge(Data1=move_5.Geometry, Data2=move_4.Geometry)

# ----
# MOVE
integer_7 = Integer(0)
vec_3 = VectorXYZ(XComponent=_400, YComponent=_0, ZComponent=integer_7)  # -> Vector, Length
move_up_and_to_cartesian = Move(Geometry=merge, Motion=vec_3.Vector)  # -> Geometry, Transform

# ----
# BASE POINTS
explode_2 = Explode(Curve=move_up_and_to_cartesian.Geometry, Recursive=True)  # -> Segments, Vertices
end_2 = EndPoints(Curve=explode_2.Segments)  # -> Start, End
len = Length(Curve=explode_2.Segments)

# ----
# BASE MOVEMENT PYTHON
zero_angle = Integer(0)
deconstruct = Deconstruct(Point=end_2.Start)  # -> XComponent, YComponent, ZComponent
gcode_formatter = Expression(
    e=speed,
    x=deconstruct.XComponent,
    y=deconstruct.YComponent,
    z=deconstruct.ZComponent,
    pitch=zero_angle,
    yaw=zero_angle,
    roll=int,
    Expression="Format(\"arm.set_position(x={0:0.00}, y={1:0.00}, z={2:0.00}, roll={3:0.00}, pitch={4:0.00}, yaw={5:0.00}, speed={6:0.00}, is_radian=False, wait=True)\", x, y, z, roll, pitch, yaw, e)")  # -> flatten(Result)
base_2_code = Panel(gcode_formatter)

x = Number(deconstruct.XComponent)
y = Number(deconstruct.YComponent)
z = Number(deconstruct.ZComponent)
pitch = Number(zero_angle)
yaw = Number(zero_angle)
panel = Panel(len)

# ----
# WALLS
# WALLS LAYER HEIGHT
layer_height = Number(number)

# ----
# TOP ISOCURVES
loft = Loft(Curves=weave_3, Options={Adjust=False, Closed=False, LoftEnds=0, LoftSimp=2, LoftType=0, Rebuild=10, Refit=0.01})
bbox_size_of_object = BoundingBox(Content=weave_3, Plane=PlaneXY(0, 0, 0))  # -> Box, Box_2
debox = DeconstructBox(Box=bbox_size_of_object.Box)  # -> Plane, X, Y, Z
dedomain = DeconstructDomain(Domain=debox.Z)  # -> Start, End
cull_i_6 = CullIndex(List=dedomain.End, Indices=1, Wrap=True)
division_4 = Division(A=cull_i_6, B=layer_height)
range_2 = Range(Domain=Domain(0, 1), Steps=division_4)
pt = ConstructPoint(XCoordinate=range_2, YCoordinate=0, ZCoordinate=0)
iso = IsoCurve(Surface=reparameterize(loft), UVPoint=pt)  # -> UIsocurve, flatten(VIsocurve)
rev = ReverseList(List=iso.VIsocurve)

# ---- group: isocurves
# BOTTOM ISOCURVES
loft_2 = Loft(Curves=weave_2, Options={Adjust=False, Closed=False, LoftEnds=0, LoftSimp=2, LoftType=0, Rebuild=10, Refit=0.01})
bbox_size_of_object_2 = BoundingBox(Content=weave_2, Plane=PlaneXY(0, 0, 0))  # -> Box, Box_2
debox_2 = DeconstructBox(Box=bbox_size_of_object_2.Box)  # -> Plane, X, Y, Z
dedomain_2 = DeconstructDomain(Domain=debox_2.Z)  # -> Start, End
division_5 = Division(A=dedomain_2.End, B=layer_height)
range_3 = Range(Domain=Domain(0, 1), Steps=division_5)
pt_2 = ConstructPoint(XCoordinate=range_3, YCoordinate=0, ZCoordinate=0)
iso_2 = IsoCurve(Surface=reparameterize(loft_2), UVPoint=pt_2)  # -> UIsocurve, flatten(VIsocurve)
rev_2 = ReverseList(List=iso_2.VIsocurve)

# ----
merge_2 = Merge(Data1=rev_2, Data2=rev)

# ----
# MOVE
addition_2 = Addition(A=addition, B=layer_height)
vec_4 = VectorXYZ(XComponent=_400, YComponent=_0, ZComponent=addition_2)  # -> Vector, Length
move_up_and_to_cartesian_2 = Move(Geometry=merge_2, Motion=vec_4.Vector)  # -> Geometry, Transform

# ----
# CURVES INTO POINTS
divide_3 = DivideCurve(Curve=reparameterize(move_up_and_to_cartesian_2.Geometry), Count=curve_points, Kinks=False)  # -> Points, flatten(Tangents), Parameters

# ----
# EXTRUSION SPEED MULTIPLIER
flip_4 = FlipMatrix(Data=divide_3.Points)
layer_ht = Number(number)
shift_list_2 = ShiftList(List=flip_4, Shift=1, Wrap=False)
line = Line(StartPoint=flip_4, EndPoint=shift_list_2)  # -> simplify(Line)
length = Length(Curve=line)
division_6 = Division(A=length, B=layer_ht)
flip_5 = FlipMatrix(Data=division_6)

# ----
# SEGMENT LENGTH
shift_list_3 = ShiftList(List=divide_3.Points, Shift=1, Wrap=True)
ln = Line(StartPoint=divide_3.Points, EndPoint=shift_list_3)
len_2 = Length(Curve=ln)
segment_length = Expression(x=len_2, Expression="Format(\"{0:0.00}\",x)")

# ----
# PITCH YAW ROLL
pframe = PerpFrame()
deplane = DeconstructPlane(Plane=pframe)  # -> Origin, XAxis, YAxis, ZAxis
rad = Radians(Degrees=zero_angle)
rev_3 = Reverse(Vector=deplane.XAxis)
line_2 = LineSDL(Start=deplane.Origin, Direction=rev_3, Length=1)
rotax = RotateAxis(Geometry=ln, Angle=rad, Axis=line_2)  # -> Geometry, Transform
X_2 = UnitX(Factor=1)
Z_2 = UnitZ(Factor=1)
Y = UnitY(Factor=1)
angle = Angle(VectorA=rotax.Geometry, VectorB=X_2)  # -> Angle, Reflex
angle_2 = Angle(VectorA=rotax.Geometry, VectorB=Y)  # -> Angle, Reflex
angle_3 = Angle(VectorA=rotax.Geometry, VectorB=Z_2)  # -> Angle, Reflex
deg = Degrees(Radians=angle.Angle)  # -> expr("round(x)", Degrees)
deg_2 = Degrees(Radians=angle_3.Angle)  # -> expr("round(x)", Degrees)
deg_3 = Degrees(Radians=angle_2.Angle)  # -> expr("round(x)", Degrees)

# ----
# PITCH YAW ROLL
pframe_2 = PerpFrame(Curve=graft(move_up_and_to_cartesian_2.Geometry), Parameter=divide_3.Parameters)
deplane_2 = DeconstructPlane(Plane=pframe_2)  # -> Origin, XAxis, YAxis, ZAxis
rev_4 = Reverse(Vector=deplane_2.XAxis)
rad_2 = Radians(Degrees=extruder_angle)
line_3 = LineSDL(Start=deplane_2.Origin, Direction=rev_4, Length=1)
rotax_2 = RotateAxis(Geometry=ln, Angle=rad_2, Axis=line_3)  # -> Geometry, Transform
Y_2 = UnitY(Factor=1)
Z_3 = UnitZ(Factor=1)
X_3 = UnitX(Factor=1)
angle_4 = Angle(VectorA=rotax_2.Geometry, VectorB=X_3)  # -> Angle, Reflex
angle_5 = Angle(VectorA=rotax_2.Geometry, VectorB=Y_2)  # -> Angle, Reflex
angle_6 = Angle(VectorA=rotax_2.Geometry, VectorB=Z_3)  # -> Angle, Reflex
deg_4 = Degrees(Radians=angle_4.Angle)  # -> expr("round(x)", Degrees)
deg_5 = Degrees(Radians=angle_6.Angle)  # -> expr("round(x)", Degrees)
deg_6 = Degrees(Radians=angle_5.Angle)  # -> expr("round(x)", Degrees)

line_4 = CherryPicker(ln, ListIndex=1)

# ----
# WALLS MOVEMENT PYTHON
deconstruct_2 = Deconstruct(Point=divide_3.Points)  # -> XComponent, YComponent, ZComponent
gcode_formatter_2 = Expression(
    e=speed,
    x=deconstruct_2.XComponent,
    y=deconstruct_2.YComponent,
    z=deconstruct_2.ZComponent,
    pitch=deg_4,
    yaw=deg_6,
    roll=deg_5,
    Expression="Format(\"arm.set_position(x={0:0.00}, y={1:0.00}, z={2:0.00}, roll={3:0.00}, pitch={4:0.00}, yaw={5:0.00}, speed={6:0.00}, is_radian=False, wait=True)\", x, y, z, roll, pitch, yaw, e)")  # -> flatten(Result)
object_code = Panel(gcode_formatter_2)

# ----
# MOVEMENT
num = Number(segment_length)

# ----
# LAYER MULTIPLIER
num_2 = Number(flip_5)

# ----
# EXTRUSION
steps_per_mm_extrusion = Expression(BRL=number_2, PIT=_7, STP=_200, A_NOZ=_1, Expression="((BRL*PIT)/STP)/A_NOZ")
lng = ListLength(List=num)
lng_2 = ListLength(List=num_2)
repeat = RepeatData(Data=steps_per_mm_extrusion, Length=lng)
extrusion_move = Multiplication(A=repeat, B=num, C=num_2)  # -> simplify(Result)
repeat_2 = RepeatData(Data=speed_3, Length=lng_2)

# ----
# MOVEMENT
num_3 = Number(segment_length)

# ----
# EXTRUSION STEPS
# EXTRUSION VOLUME
# armspeed per second
# extruder steps
# per second
# extrusion per step
flip_points = FlipMatrix(Data=divide_3.Points)
extrusion_width_2 = Integer(extrusion_width)
shift_list_4 = ShiftList(List=flip_points, Shift=1, Wrap=False)
line_5 = Line(StartPoint=flip_points, EndPoint=shift_list_4)  # -> simplify(Line)
length_2 = Length(Curve=line_5)
midpt = CurveMiddle(Curve=line_5)
division_7 = Division(A=length_2, B=2)
lng_3 = ListLength(List=midpt)
division_8 = Division(A=extrusion_width_2, B=2)
repeat_3 = RepeatData(Data=division_8, Length=lng_3)
ellipse_2 = Ellipse(Plane=midpt, Radius1=repeat_3, Radius2=division_7)  # -> Ellipse, Focus1, Focus2
flip_6 = FlipMatrix(Data=ellipse_2.Ellipse)
lng_4 = ListLength(List=flip_6)
lng_5 = ListLength(List=flip_6)
areamult = RepeatData(Data=area_mult, Length=lng_5)
extr_area = Area(Geometry=flip_6)  # -> Area, Centroid
armspeed = RepeatData(Data=speed_2, Length=lng_4)
multiplication_2 = Multiplication(A=extr_area.Area, B=areamult)
steps_per_mm_extrusion_2 = Expression(BRL=number_3, PIT=_7_2, STP=_200_2, A_NOZ=_1_2, Expression="((BRL*PIT)/STP)/A_NOZ")
division_9 = Division(Armspeed=speed_3, _60=60)
lng_6 = ListLength(List=num_3)
extrusion_volume = Multiplication(Area=multiplication_2, Length=num_3)
repeat_4 = RepeatData(Data=steps_per_mm_extrusion_2, Length=lng_6)
repeat_5 = RepeatData(Data=division_9, Length=lng_6)
divide_4 = Division(Volume2extrude=simplify(extrusion_volume), Mm3PerStep=simplify(repeat_4))
round = Round(Number=divide_4)  # -> Nearest, Floor, Ceiling
division_10 = Division(A=round.Nearest, B=repeat_5)  # -> simplify(Result)

height = CherryPicker(line_5, ListIndex=1)
ellipse_3 = CherryPicker(flip_6, ListIndex=1)
panel_2 = Panel(extr_area.Area)
division_11 = Division(A=arm_mm_sec, B=steps_per_mm_extrusion)
int_2 = Integer(division_11)
panel_3 = Panel(extrusion_move)
panel_4 = Panel(round.Nearest)
panel_5 = Panel(division_10)

# ----
# HEX CONVERTERS
big_endian = BooleanToggle(True)
move_6 = GhPythonScript(x=round.Nearest, big=big_endian)  # -> out, a
# ---------- move_6: Python ----------
__author__ = "morr0289"
__version__ = "2023.07.05"

import rhinoscriptsyntax as rs
import math


z = int (x * 1)
h = str(hex(z))
s = h.lstrip("0x")
e = s.zfill(4)
if big:
    f = e[0]
    g = e[1]
    h = e[2]
    i = e[3]
else:
    f = e[2]
    g = e[3]
    h = e[0]
    i = e[1]
j = "0x"
k = ","
a = j+f+g+k+j+h+i
# ---------- end move_6 ----------
speed_4 = GhPythonScript(x=division_10, big=big_endian)  # -> out, a; same code as move_6

# ----
# HEX CONVERTERS
big_endian_2 = BooleanToggle(True)
speed_5 = GhPythonScript(x=int_2, big=big_endian_2)  # -> out, a, b
# ---------- speed_5: Python ----------
__author__ = "morr0289"
__version__ = "2023.07.05"

import rhinoscriptsyntax as rs
import math
z = int(x*1)
h = str(hex(z))
s = h.lstrip("0x")
e = s.zfill(4)
if big:
    f = e[0]
    g = e[1]
    h = e[2]
    i = e[3]
else:
    f = e[2]
    g = e[3]
    h = e[0]
    i = e[1]
j = "0x"
k = ","
a = j+f+g+k+j+h+i
b=z
# ---------- end speed_5 ----------
move_7 = GhPythonScript(x=len, big=big_endian_2)  # -> out, a, b
# ---------- move_7: Python ----------
__author__ = "morr0289"
__version__ = "2023.07.05"

import rhinoscriptsyntax as rs
import math


z = int (x * 1)
print(z)
h = str(hex(z))
s = h.lstrip("0x")
e = s.zfill(4)
if big:
    f = e[0]
    g = e[1]
    h = e[2]
    i = e[3]
else:
    f = e[2]
    g = e[3]
    h = e[0]
    i = e[1]
j = "0x"
k = ","
a = j+f+g+k+j+h+i
b=z
# ---------- end move_7 ----------

# ----
# LINES
int_3 = Integer(1)
lng_7 = ListLength(List=gcode_formatter_2)
lng_8 = ListLength(List=base_2_code)
series_2 = Series(Start=0, Step=int_3, Count=lng_7)
series_3 = Series(Start=0, Step=int_3, Count=lng_8)

# ----
# HEX CONVERTERS
big_endian_3 = BooleanToggle(True)
line_6 = GhPythonScript(x=series_3, big=big_endian_3)  # -> out, a, b; same code as move_7
line_7 = GhPythonScript(x=series_2, big=big_endian_3)  # -> out, a, b; same code as speed_5

# ----
# FORMAT EXTRUSION
direction = Panel("0x00,0x01")
slave_id = Panel("0x09")
line_8 = Text(line_7.a)
move_8 = Text(move_6.a)
speed_6 = Text(speed_4.a)
gcode_formatter_3 = Expression(
    slaveid=slave_id,
    move=flatten(move_8),
    speed=flatten(speed_6),
    dir=direction,
    line=line_8,
    Expression="Format(\"datas = [{0},0x10,0x00,0x00,0x00,0x05,0x0a,{1},{2},{3},{4},0x00,0x00]\",slaveid, line, move, speed, dir)")
function_line = Panel("sender(datas)")
tab = Panel("\t")
lng_9 = ListLength(List=gcode_formatter_3)
txt = Text(tab)
repeat_6 = RepeatData(Data=function_line, Length=lng_9)
lng_10 = ListLength(List=gcode_formatter_3)
repeat_7 = RepeatData(Data="arm.clean_error()", Length=lng_10)
weave_5 = Weave(
    Pattern=[3, 1, 2, 0],
    Stream0=gcode_formatter_2,
    Stream1=gcode_formatter_3,
    Stream2=repeat_6,
    Stream3=repeat_7,
    NullGaps=False)
concat = Concatenate(FragmentA=txt, FragmentB=weave_5)

# ----
# MODBUS TO EXCEL
lng_11 = ListLength(List=move_7.a)
repeat_8 = RepeatData(Data=speed_5.a, Length=lng_11)
merge_3 = Merge(Data1=flatten(repeat_8), Data2=flatten(speed_4.a))
merge_4 = Merge(Data1=flatten(move_7.a), Data2=flatten(move_6.a))
lng_12 = ListLength(List=merge_3)
repeat_9 = RepeatData(Data=direction, Length=lng_12)
repeat_10 = RepeatData(Data="0x00,0x00", Length=lng_12)
line_9 = Number(series_3)
gcode_formatter_4 = Expression(
    index=line_7.a,
    move=merge_4,
    speed=merge_3,
    dir=repeat_9,
    line=line_7.a,
    end=repeat_10,
    Expression="Format(\"{0},{1},{2},{3},{4}\",line,move,speed,dir,end)")
lng_13 = ListLength(List=flatten(line_9))
speed_7 = Number(int_2)
move_9 = Number(len)
ext_speed = RepeatData(Data=speed_7, Length=lng_13)
dir = RepeatData(Data=1, Length=lng_13)
end_3 = RepeatData(Data=0, Length=lng_13)
pitch_2 = RepeatData(Data=0, Length=lng_13)
yaw_2 = RepeatData(Data=0, Length=lng_13)
roll_2 = RepeatData(Data=-180, Length=lng_13)
espeed = RepeatData(Data=150, Length=lng_13)
panel_6 = Panel("C:\Users\morr0289\Documents\GitHub\RobotArm\Python\final\grassData.xlsx")
panel_7 = Panel(gcode_formatter_4)
expression = Expression(x=move_9, Expression="Round(x,0)")  # -> flatten(R)
weave_6 = Weave(
    Pattern=[0, 1, 2, 3, 4, 5, 6, 7, 8, 9, 10, 11, 12],
    Stream0=line_9,
    Stream1=line_9,
    Stream2=flatten(expression),
    Stream3=ext_speed,
    Stream4=dir,
    Stream5=end_3,
    Stream6=flatten(x),
    Stream7=flatten(y),
    Stream8=flatten(z),
    Stream9=pitch_2,
    Stream10=roll_2,
    Stream11=yaw_2,
    Stream12=espeed,
    NullGaps=False)
panel_8 = Panel(panel_7)
panel_9 = Panel("""index
line
move
espeed
direction
end
x
y
z
pitch
yaw
roll
fspeed""")
multiplication_3 = Multiplication(A=250, B=13)
subtraction = Subtraction(A=multiplication_3, B=1)
partition = PartitionList(List=weave_6, Size=13)  # -> simplify(Chunks)
dom = ConstructDomain(DomainStart=0, DomainEnd=subtraction)
clr_values = BooleanToggle(True)
clr_formats = BooleanToggle(True)
save = BooleanToggle(True)
write = BooleanToggle(False)
subset = SubList(List=weave_6, Domain=dom, Wrap=False)  # -> List, Index
panel_10 = Panel("C:\Users\morr0289\Documents\GitHub\RobotArm\Python\final\grassDataShort.xlsx")
write_2 = BooleanToggle(False)
xl_settings = ExcelSettings(ClearValues=clr_values, ClearFormatting=clr_formats, Save=save, Close=Toggle(False))
partition_2 = PartitionList(List=subset.List, Size=13)  # -> simplify(Chunks)
xl_out = WriteToExcelClassic(WorkbookFilepath=panel_6, WorksheetName="1", Data=partition, LocationAddress="A2", Settings=xl_settings, Stream=write)
xl_out_2 = WriteToExcelClassic(
    WorkbookFilepath=panel_10,
    WorksheetName="1",
    Data=partition_2,
    LocationAddress="A2",
    Settings=xl_settings,
    Stream=write_2)
panel_11 = Panel(partition)
panel_12 = Panel(partition_2)

# ----
# FORMAT EXTRUSION
slave_id_2 = Panel("0x09")
direction_2 = Panel("0x00,0x01")
move_10 = Text(move_7.a)
speed_8 = Text(speed_5.a)
line_10 = Text(line_6.a)
gcode_formatter_5 = Expression(
    slaveid=slave_id_2,
    move=flatten(move_10),
    speed=flatten(speed_8),
    dir=direction_2,
    line=line_10,
    Expression="Format(\"datas = [{0},0x10,0x00,0x00,0x00,0x05,0x0a,{1},{2},{3},{4},0x00,0x00]\",slaveid, line,move, speed, dir)")
lng_14 = ListLength(List=gcode_formatter_5)
lng_15 = ListLength(List=gcode_formatter_5)
tab_2 = Panel("\t")
txt_2 = Text(tab_2)
repeat_11 = RepeatData(Data="arm.clean_error()", Length=lng_15)
repeat_12 = RepeatData(Data="sender(datas)", Length=lng_14)
weave_7 = Weave(
    Pattern=[3, 1, 0, 2],
    Stream0=gcode_formatter_5,
    Stream1=base_2_code,
    Stream2=repeat_12,
    Stream3=repeat_11,
    NullGaps=False)
concat_2 = Concatenate(FragmentA=txt_2, FragmentB=weave_7)

# ----
# data subset with comments for debugging
# modbus comments
panel_13 = Panel(speed_5.b)
panel_14 = Panel(move_7.b)
lng_16 = ListLength(List=flatten(panel_13))
int_4 = Integer(9)
repeat_13 = RepeatData(Data="0x00,0x01", Length=lng_16)
int_5 = Integer(1)
gcode_formatter_6 = Expression(
    slaveid=int_4,
    move=flatten(panel_14),
    speed=flatten(panel_13),
    dir=direction_2,
    Expression="Format(\"#datas = [{0},func16,start1,start2,numreg1,numreg2,numbytes,{1},{2},0x00,{3}]\",slaveid, move, speed, dir)")
repeat_14 = RepeatData(Data=int_5, Length=lng_16)
gcode_formatter_7 = Expression(move=flatten(move_7.a), speed=flatten(speed_5.a), dir=repeat_13, Expression="Format(\"{0},{1},{2}\",move, speed, dir)")
gcode_formatter_8 = Expression(move=flatten(panel_14), speed=flatten(panel_13), dir=repeat_14, Expression="Format(\"{0},{1},{2}\",move, speed, dir)")
panel_15 = Panel(gcode_formatter_7)
relative = BooleanToggle(False)
overwrite = BooleanToggle(True)
write_3 = BooleanToggle(True)
path = FilePath("C:\Users\morr0289\Documents\GitHub\RobotArm\Python\programs\ext_data.txt")
txt_writer = TextDocumentWriter(relative=relative, file=path, lines=gcode_formatter_8, write=write_3, overwrite=overwrite)  # inputs relative: Boolean, lines: list, write: Boolean, overwrite: Boolean, append: Boolean
# ---------- txt_writer: Python ----------
"""
Writes to a TXT or CSV file.
    Inputs:
        relative: Set to 'True' to create a new Text File using relative path. This file will live in the same directory as the Grasshopper document.
        file: TXT or CSV file to write to.
        lines: Text to write.
        write: Set to True to write.
        overwrite: Set to True to overwrite the specified file.
        append: Set to True to append the specified file.
"""

# Stephen P. Maher /  2015

ghenv.Component.Name = "Text Document Writer"
ghenv.Component.NickName = 'TXT-Writer'

import Grasshopper as gh
import os

if not relative and not file:
    msg = "Set either 'relative' to True or connect a file path to input parameter 'file'."
    ghenv.Component.AddRuntimeMessage(gh.Kernel.GH_RuntimeMessageLevel.Warning, msg)
elif relative == True:
    if overwrite == True and append == True:
        msg = "Set either 'overwrite' or 'append' to True."
        ghenv.Component.AddRuntimeMessage(gh.Kernel.GH_RuntimeMessageLevel.Error, msg)
    elif write:
        gh_path = ghdoc.Path # Get GH document's file path
        name = gh_path.split(".")[0]
        new = name.split("\\")
        file_name = new[4] + "_text_file.txt" # Create text file name
        dir = os.path.dirname(os.path.realpath(gh_path))
        file = os.path.join(dir, file_name) # Create text file path
        filePath = open(file, "w") # Open text file to create it
        if os.stat(file).st_size == 0: # Check to see if file has any data and continue if it's empty
            filePath = open(file, "w") # Open the file
            for line in lines: # Iterate through lines
                filePath.write(line + "\n") # Write separate lines
            filePath.close() # Close the file
        elif os.stat(file).st_size >= 1 and overwrite == False and append == False: # Check if file has data; if it does and 'overwrite' is  set to False, warn the user
            msg = "This file has content. If you wish to overwrite or append the file, please set either input parameters 'overwrite' or 'append' to True."
            ghenv.Component.AddRuntimeMessage(gh.Kernel.GH_RuntimeMessageLevel.Error, msg)
        elif os.stat(file).st_size >= 1 and overwrite == True: # If file has data and 'overwrite' set to True continue
            filePath = open(file, "w") # Open the file
            for line in lines: # Iterate through lines
                filePath.write(line + "\n") # Write separate lines
            filePath.close() # Close the file
        elif os.stat(file).st_size >= 1 and append == True: # If file has data and 'append' set to True and 'overwrite set to False  continue
            filePath = open(file, "a") # Open the file and 'append' document
            for line in lines: # Iterate through lines
                filePath.write("\n" + line) # Write separate lines
            filePath.close() # Close the file
    else:
        msg = "Set 'write' to True."
        ghenv.Component.AddRuntimeMessage(gh.Kernel.GH_RuntimeMessageLevel.Warning, msg)
elif relative == False or not relative:
    open(file, "w")
    if file:
        if overwrite == True and append == True:
            msg = "Set either 'overwrite' or 'append' to True."
            ghenv.Component.AddRuntimeMessage(gh.Kernel.GH_RuntimeMessageLevel.Error, msg)
        elif write:
            if os.stat(file).st_size == 0: # Check to see if file has any data and continue if it's empty
                filePath = open(file, "w") # Open the file
                for line in lines: # Iterate through lines
                    filePath.write(line + "\n") # Write separate lines
                filePath.close() # Close the file
            elif os.stat(file).st_size >= 1 and overwrite == False and append == False: # Check if file has data; if it does and 'overwrite' is  set to False, warn the user
                msg = "This file has content. If you wish to overwrite or append the file, please set either input parameters 'overwrite' or 'append' to True."
                ghenv.Component.AddRuntimeMessage(gh.Kernel.GH_RuntimeMessageLevel.Error, msg)
            elif os.stat(file).st_size >= 1 and overwrite == True: # If file has data and 'overwrite' set to True continue
                filePath = open(file, "w") # Open the file
                for line in lines: # Iterate through lines
                    filePath.write(line + "\n") # Write separate lines
                filePath.close() # Close the file
            elif os.stat(file).st_size >= 1 and append == True: # If file has data and 'append' set to True and 'overwrite set to False  continue
                filePath = open(file, "a") # Open the file and 'append' document
                for line in lines: # Iterate through lines
                    filePath.write("\n" + line) # Write separate lines
                filePath.close() # Close the file
        else:
            msg = "Set 'write' to True."
            ghenv.Component.AddRuntimeMessage(gh.Kernel.GH_RuntimeMessageLevel.Warning, msg)
    else:
        msg = "Input parameter 'file' failed to collect data."
        ghenv.Component.AddRuntimeMessage(gh.Kernel.GH_RuntimeMessageLevel.Warning, msg)
# ---------- end txt_writer ----------
weave_8 = Weave(Pattern=[1, 2, 0], Stream0=repeat_12, Stream1=gcode_formatter_5, Stream2=gcode_formatter_6, NullGaps=False)
subset_2 = SubList(List=weave_8, Domain="0 to 89", Wrap=True)  # -> List, Index
panel_16 = Panel(subset_2.List)

# ----
# ASSEMBLE
ip_address = Panel("192.168.1.240")
main_code = Panel("""id = 9
baudRate = 9600

code, digitals = arm.get_tgpio_digital()

if arm.warn_code != 0:
    arm.clean_warn()
if arm.error_code != 0:
    arm.clean_error()
time.sleep(2)

ret = arm.core.set_modbus_timeout(7)  
print('set modbus timeout, ret = %d' % (ret[0]))    
ret = arm.core.set_modbus_baudrate(baudRate)  
print('set modbus baudrate, ret = %d' % (ret[0]))

time.sleep(1)
line = 104

def errors(returned):
    if returned == 1:
        print('1: uncleared error exists')
    elif returned == 23:
        print('23:modbus reply length error')
    elif returned == 20:
        print('20: wrong slave id')
    elif returned == 15:
        print('15: Modbus commands full')
    elif returned == 19:
        print('19: communication error')
    elif returned == 28:
        print('28: end module communication error')
    else:
        print('other error: ',returned)
    input=('clear errors? (y/n)')
    if input == 'y':
            arm.clean_error()
    else:
        print('error not cleared; quitting...')
        time.sleep(2)
        quit()

def sender(data_frame):
    global id
    arm.clean_error()
    time.sleep(.01)
    #while arm.connected and arm.error_code != 19 and arm.error_code != 28:
    if code == 0 and digitals[0] == 1:
        print ('extruder reports ready')
        ret = arm.getset_tgpio_modbus_data(data_frame,host_id=id)
        if ret[0] == 0:
            #print('wrote move: ',data_frame[8],data_frame[9],data_frame[10])
            print('wrote move: ',data_frame[9],data_frame[10])
            print('wrote speed: ',data_frame[11],data_frame[12])
            print('wrote line: ',data_frame[13],data_frame[14])
            print('wrote end: ',data_frame[15],data_frame[16])
            print('got back this: ',ret[1])
            #line += 3
    elif digitals [0] == 0:
        print('extruder reports not ready')
    elif code != 0:
        errors(ret[0])

arm.motion_enable(enable=True)
arm.set_mode(0)
arm.set_state(state=0)

arm.set_tcp_load(weight=0.91, center_of_gravity=[0,80,-40]) 
arm.set_tcp_offset([0,0,111.5,0,30.3,0], is_radian=False)
arm.set_collision_tool_model(22, x=40, y=40, z=111.5)

last_digitals = [-1, -1]

'''TGPIO for air solenoid---------------------------------------------
value = 0

    code = arm.set_cgpio_digital_output_function(i, value)
    print('set_cgpio_digital_output_function({}, {}), code={}'.format(i, value, code))
# Reset: 255
for i in range(4, 8):
    code = arm.set_cgpio_digital_output_function(i, 255)
    print('set_cgpio_digital_output_function({}, {}), code={}'.format(i, value, code))'''


arm.reset(wait=True)
if arm.warn_code != 0:
    arm.clean_warn()
if arm.error_code != 0:
    arm.clean_error()
time.sleep(2)

'''datas format: [0x09: slave id,0x10 function 16 write registers,0x00,0x00 beginning address to write,0x00,0x05 number of registers,0x0a number of bytes(2x registers),0x00,0x15 register 0 movement,0x00,0x06 register 1 speed,0x00,0x01 register 2 direction,0x00,0x64 register 3 line number,0x00,0x00 register 4 end of file]'''

while arm.connected:""")
robot_footer = Panel("""#finish up:   
datas =[0x09,0x10,0x00,0x00,0x00,0x05,0x0a,0x00,0x00,0x00,0x00,0x00,0x00,0x00,0x00,0x00,0x01]
sender(datas)
time.sleep(2)
arm.reset(wait=True)
arm.disconnect()""")
heading = Panel("""#generated with Grasshopper for Rhino
#Chris Morrey

import os
import sys
import time
import math

sys.path.append("C:\\Users\\morr0289\\Documents\\Github\\RobotArm\\Python\\")

from ..arm_sdk3.xarm.wrapper.xarm_api import XArmAPI""")
expression_2 = Expression(x=ip_address, Expression="Format(\"arm = XArmAPI('{0}')\", x)")
lng_17 = ListLength(List=main_code)
lng_18 = ListLength(List=heading)
lng_19 = ListLength(List=expression_2)
code_length = Addition(A=lng_18, B=lng_19, C=lng_17)
top = Merge(Data1=heading, Data2=expression_2, Data3=main_code)
merge_5 = Merge(Data1=top, Data2=flatten(concat_2), Data3=flatten(concat), Data4=flatten(robot_footer))  # -> flatten(Result)
panel_17 = Panel(merge_5)

# ----
# MODBUS LINES ONLY
modonly = Weave(Pattern=[0, 1], Stream0=gcode_formatter_5, Stream1=repeat_12, NullGaps=False)
concat_3 = Concatenate(FragmentA=txt_2, FragmentB=modonly)
merge_6 = Merge(Data1=simplify(flatten(top)), Data2=simplify(flatten(concat_3)), Data3=simplify(flatten(robot_footer)))
panel_18 = Panel(merge_6)

# ----
# FULL CODE SHORT
panel_19 = Panel("0 to 301")
subset_3 = SubList(List=merge_5, Domain=panel_19, Wrap=False)  # -> flatten(List), Index
merge_7 = Merge(Data1=subset_3.List, Data2=robot_footer)
panel_20 = Panel(merge_7)

# ----
# MODBUS LINES SHORT
subset_4 = SubList(List=merge_6, Domain=[Domain(0, 301), Domain(9706, 9711)], Wrap=False)  # -> List, Index
panel_21 = Panel(subset_4.List)
