# Grasshopper definition xArm6core_db_walls.gh (Grasshopper 1.0.7)
# plug-ins: CORE.Toolbox.Grasshopper

# ---- group: make 3 curves
# MAKE 3 CURVES
radius_1 = Slider(131, range=20..200)
# CONSTRUCT WALLS
plane = Plane(PlaneXY(0, 0, 0))
half_height = Slider(60, range=20..200)
curve_height = Slider(25, range=20..200)
ellipse = Ellipse(Plane=plane, Radius1=radius_1, Radius2=Slider(60, range=20..200))  # -> Ellipse, Focus1, Focus2
vec = VectorXYZ(XComponent=Slider(0.541, range=0..1), YComponent=Slider(0, range=0..1), ZComponent=half_height)  # -> Vector, Length
_3 = Integer(3)
arrlinear = LinearArray(Geometry=ellipse.Ellipse, Direction=vec.Vector, Count=_3)  # -> Geometry, Transform
_4 = Integer(4)
integer = Integer([0, 2])
cull_i = CullIndex(List=arrlinear.Geometry, Indices=integer, Wrap=True)
divide = DivideCurve(Curve=cull_i, Count=_4, Kinks=False)  # -> Points, Tangents, Parameters
integer_2 = Integer([0, 2])
integer_3 = Integer([1, 3])
vec_2 = VectorXYZ(XComponent=Slider(0, range=0..1), YComponent=Slider(0, range=0..1), ZComponent=curve_height)  # -> Vector, Length
cull_i_2 = CullIndex(List=divide.Points, Indices=integer_3, Wrap=True)
cull_i_3 = CullIndex(List=divide.Points, Indices=integer_2, Wrap=True)
move = Move(Geometry=cull_i_3, Motion=vec_2.Vector)  # -> Geometry, Transform
integer_4 = Integer(-2)
weave = Weave(Pattern=[0, 1], Stream0=cull_i_2, Stream1=move.Geometry, NullGaps=False)
division = Division(A=curve_height, B=integer_4)
integer_5 = Integer([1, 2])
integer_6 = Integer([0, 1])
Z = UnitZ(Factor=division)
intcrv = Interpolate(Vertices=weave, Degree=3, Periodic=True, KnotStyle=1)  # -> Curve, Length, Domain
cull_i_4 = CullIndex(List=arrlinear.Geometry, Indices=integer_6, Wrap=True)
cull_i_5 = CullIndex(List=arrlinear.Geometry, Indices=integer_5, Wrap=True)
move_2 = Move(Geometry=intcrv.Curve, Motion=Z)  # -> Geometry, Transform
weave_2 = Weave(Pattern=[0, 1], Stream0=move_2.Geometry, Stream1=cull_i_5, NullGaps=False)
weave_3 = Weave(Pattern=[0, 1], Stream0=cull_i_4, Stream1=move_2.Geometry, NullGaps=False)

# ----
# EXTRUSION WIDTH
extrusion_width = Slider(2.55, range=1..5)

# ----
# EXTRUDER ANGLE
extruder_angle = Slider(120, range=0..180)

# ----
# NUM CURVE POINTS
curve_points = Slider(20, range=20..200)

# ----
# X POSITION
_400 = Integer(400)

# ----
# ARM SPEED
speed = Number(150)

# ----
# Y POSITION
_0 = Integer(0)

# ----
# LAYER HEIGHT
number = Number(1.85)

# ----
# AREA MULTIPLIER
area_mult = Slider(1, range=0.5..1.5)

# ----
# ARMSPEED mm/min
speed_2 = Integer(speed)

speed_3 = Integer(speed_2)
_180 = Integer(-180)

# ----
# NOZZLE RADIUS
_1 = Number(expr("x²*π", 1))

# ----
# STEPS PER ROTATION
_200 = Integer(200)

# ----
# BARREL AREA
number_2 = Number(75.39)  # "75.39"

# ----
# AUGER PITCH
_7 = Integer(7)

# ----
# HEX CONVERTERS
big_endian = BooleanToggle(True)
speed_4 = GhPythonScript(big=big_endian)  # -> out, a, b
# ---------- speed_4: Python ----------
__author__ = "morr0289"
__version__ = "2023.07.05"

import rhinoscriptsyntax as rs
import math
z = int(x*1)
h = str(hex(z))
s = h.lstrip("0x")
e = s.zfill(4)
if big:
    f = e[0]
    g = e[1]
    h = e[2]
    i = e[3]
else:
    f = e[2]
    g = e[3]
    h = e[0]
    i = e[1]
j = "0x"
k = ","
a = j+f+g+k+j+h+i
b=z
# ---------- end speed_4 ----------

# ----
# data subset with comments for debugging
# modbus comments
panel = Panel(speed_4.b)
panel_2 = Panel()
lng = ListLength(List=flatten(panel))
int = Integer(9)
repeat = RepeatData(Data="0x00,0x01", Length=lng)
int_2 = Integer(1)
gcode_formatter = Expression(
    slaveid=int,
    move=flatten(panel_2),
    speed=flatten(panel),
    Expression="Format(\"#datas = [{0},func16,start1,start2,numreg1,numreg2,numbytes,{1},{2},0x00,{3}]\",slaveid, move, speed, dir)")
repeat_2 = RepeatData(Data=int_2, Length=lng)
gcode_formatter_2 = Expression(speed=flatten(speed_4.a), dir=repeat, Expression="Format(\"{0},{1},{2}\",move, speed, dir)")
gcode_formatter_3 = Expression(move=flatten(panel_2), speed=flatten(panel), dir=repeat_2, Expression="Format(\"{0},{1},{2}\",move, speed, dir)")
panel_3 = Panel(gcode_formatter_2)
relative = BooleanToggle(False)
overwrite = BooleanToggle(True)
write = BooleanToggle(True)
path = FilePath("C:\Users\morr0289\Documents\GitHub\RobotArm\Python\programs\ext_data.txt")
txt_writer = TextDocumentWriter(relative=relative, file=path, lines=gcode_formatter_3, write=write, overwrite=overwrite)  # inputs relative: Boolean, lines: list, write: Boolean, overwrite: Boolean, append: Boolean
# ---------- txt_writer: Python ----------
"""
Writes to a TXT or CSV file.
    Inputs:
        relative: Set to 'True' to create a new Text File using relative path. This file will live in the same directory as the Grasshopper document.
        file: TXT or CSV file to write to.
        lines: Text to write.
        write: Set to True to write.
        overwrite: Set to True to overwrite the specified file.
        append: Set to True to append the specified file.
"""

# Stephen P. Maher /  2015

ghenv.Component.Name = "Text Document Writer"
ghenv.Component.NickName = 'TXT-Writer'

import Grasshopper as gh
import os

if not relative and not file:
    msg = "Set either 'relative' to True or connect a file path to input parameter 'file'."
    ghenv.Component.AddRuntimeMessage(gh.Kernel.GH_RuntimeMessageLevel.Warning, msg)
elif relative == True:
    if overwrite == True and append == True:
        msg = "Set either 'overwrite' or 'append' to True."
        ghenv.Component.AddRuntimeMessage(gh.Kernel.GH_RuntimeMessageLevel.Error, msg)
    elif write:
        gh_path = ghdoc.Path # Get GH document's file path
        name = gh_path.split(".")[0]
        new = name.split("\\")
        file_name = new[4] + "_text_file.txt" # Create text file name
        dir = os.path.dirname(os.path.realpath(gh_path))
        file = os.path.join(dir, file_name) # Create text file path
        filePath = open(file, "w") # Open text file to create it
        if os.stat(file).st_size == 0: # Check to see if file has any data and continue if it's empty
            filePath = open(file, "w") # Open the file
            for line in lines: # Iterate through lines
                filePath.write(line + "\n") # Write separate lines
            filePath.close() # Close the file
        elif os.stat(file).st_size >= 1 and overwrite == False and append == False: # Check if file has data; if it does and 'overwrite' is  set to False, warn the user
            msg = "This file has content. If you wish to overwrite or append the file, please set either input parameters 'overwrite' or 'append' to True."
            ghenv.Component.AddRuntimeMessage(gh.Kernel.GH_RuntimeMessageLevel.Error, msg)
        elif os.stat(file).st_size >= 1 and overwrite == True: # If file has data and 'overwrite' set to True continue
            filePath = open(file, "w") # Open the file
            for line in lines: # Iterate through lines
                filePath.write(line + "\n") # Write separate lines
            filePath.close() # Close the file
        elif os.stat(file).st_size >= 1 and append == True: # If file has data and 'append' set to True and 'overwrite set to False  continue
            filePath = open(file, "a") # Open the file and 'append' document
            for line in lines: # Iterate through lines
                filePath.write("\n" + line) # Write separate lines
            filePath.close() # Close the file
    else:
        msg = "Set 'write' to True."
        ghenv.Component.AddRuntimeMessage(gh.Kernel.GH_RuntimeMessageLevel.Warning, msg)
elif relative == False or not relative:
    open(file, "w")
    if file:
        if overwrite == True and append == True:
            msg = "Set either 'overwrite' or 'append' to True."
            ghenv.Component.AddRuntimeMessage(gh.Kernel.GH_RuntimeMessageLevel.Error, msg)
        elif write:
            if os.stat(file).st_size == 0: # Check to see if file has any data and continue if it's empty
                filePath = open(file, "w") # Open the file
                for line in lines: # Iterate through lines
                    filePath.write(line + "\n") # Write separate lines
                filePath.close() # Close the file
            elif os.stat(file).st_size >= 1 and overwrite == False and append == False: # Check if file has data; if it does and 'overwrite' is  set to False, warn the user
                msg = "This file has content. If you wish to overwrite or append the file, please set either input parameters 'overwrite' or 'append' to True."
                ghenv.Component.AddRuntimeMessage(gh.Kernel.GH_RuntimeMessageLevel.Error, msg)
            elif os.stat(file).st_size >= 1 and overwrite == True: # If file has data and 'overwrite' set to True continue
                filePath = open(file, "w") # Open the file
                for line in lines: # Iterate through lines
                    filePath.write(line + "\n") # Write separate lines
                filePath.close() # Close the file
            elif os.stat(file).st_size >= 1 and append == True: # If file has data and 'append' set to True and 'overwrite set to False  continue
                filePath = open(file, "a") # Open the file and 'append' document
                for line in lines: # Iterate through lines
                    filePath.write("\n" + line) # Write separate lines
                filePath.close() # Close the file
        else:
            msg = "Set 'write' to True."
            ghenv.Component.AddRuntimeMessage(gh.Kernel.GH_RuntimeMessageLevel.Warning, msg)
    else:
        msg = "Input parameter 'file' failed to collect data."
        ghenv.Component.AddRuntimeMessage(gh.Kernel.GH_RuntimeMessageLevel.Warning, msg)
# ---------- end txt_writer ----------
weave_4 = Weave(Pattern=[1, 2, 0], Stream2=gcode_formatter, NullGaps=False)
subset = SubList(List=weave_4, Domain="0 to 89", Wrap=True)  # -> List, Index
panel_4 = Panel(subset.List)

_1_2 = Integer(1)
int_3 = Integer(3242)

# ----
# WRITE TO SHEET
write_2 = BooleanToggle(False)

# ----
# WALLS
# WALLS LAYER HEIGHT
layer_height = Number(number)

# ----
# TOP ISOCURVES
loft = Loft(Curves=weave_3, Options={Adjust=False, Closed=False, LoftEnds=0, LoftSimp=2, LoftType=0, Rebuild=10, Refit=0.01})
bbox_size_of_object = BoundingBox(Content=weave_3, Plane=PlaneXY(0, 0, 0))  # -> Box, Box_2
debox = DeconstructBox(Box=bbox_size_of_object.Box)  # -> Plane, X, Y, Z
dedomain = DeconstructDomain(Domain=debox.Z)  # -> Start, End
cull_i_6 = CullIndex(List=dedomain.End, Indices=1, Wrap=True)
division_2 = Division(A=cull_i_6, B=layer_height)
range = Range(Domain=Domain(0, 1), Steps=division_2)
pt = ConstructPoint(XCoordinate=range, YCoordinate=0, ZCoordinate=0)
iso = IsoCurve(Surface=reparameterize(loft), UVPoint=pt)  # -> UIsocurve, flatten(VIsocurve)
rev = ReverseList(List=iso.VIsocurve)

# ---- group: isocurves
# BOTTOM ISOCURVES
loft_2 = Loft(Curves=weave_2, Options={Adjust=False, Closed=False, LoftEnds=0, LoftSimp=2, LoftType=0, Rebuild=10, Refit=0.01})
bbox_size_of_object_2 = BoundingBox(Content=weave_2, Plane=PlaneXY(0, 0, 0))  # -> Box, Box_2
debox_2 = DeconstructBox(Box=bbox_size_of_object_2.Box)  # -> Plane, X, Y, Z
dedomain_2 = DeconstructDomain(Domain=debox_2.Z)  # -> Start, End
division_3 = Division(A=dedomain_2.End, B=layer_height)
range_2 = Range(Domain=Domain(0, 1), Steps=division_3)
pt_2 = ConstructPoint(XCoordinate=range_2, YCoordinate=0, ZCoordinate=0)
iso_2 = IsoCurve(Surface=reparameterize(loft_2), UVPoint=pt_2)  # -> UIsocurve, flatten(VIsocurve)
rev_2 = ReverseList(List=iso_2.VIsocurve)

# ----
merge = Merge(Data1=rev_2, Data2=rev)

# ----
# MOVE
addition = Addition(B=layer_height)
vec_3 = VectorXYZ(XComponent=_400, YComponent=_0, ZComponent=addition)  # -> Vector, Length
# ADD JSON
# PARSER HERE
move_up_and_to_cartesian = Move(Geometry=merge, Motion=vec_3.Vector)  # -> Geometry, Transform

# ----
# CURVES INTO POINTS
divide_2 = DivideCurve(Curve=reparameterize(move_up_and_to_cartesian.Geometry), Count=curve_points, Kinks=False)  # -> Points, flatten(Tangents), Parameters

# ----
# SEGMENT LENGTH
shift_list = ShiftList(List=divide_2.Points, Shift=1, Wrap=True)
ln = Line(StartPoint=divide_2.Points, EndPoint=shift_list)
len = Length(Curve=ln)
segment_length = Expression(x=len, Expression="Format(\"{0:0.00}\",x)")

# ----
# PITCH YAW ROLL
pframe = PerpFrame(Curve=graft(move_up_and_to_cartesian.Geometry), Parameter=divide_2.Parameters)
deplane = DeconstructPlane(Plane=pframe)  # -> Origin, XAxis, YAxis, ZAxis
rev_3 = Reverse(Vector=deplane.XAxis)
rad = Radians(Degrees=extruder_angle)
line = LineSDL(Start=deplane.Origin, Direction=rev_3, Length=1)
rotax = RotateAxis(Geometry=ln, Angle=rad, Axis=line)  # -> Geometry, Transform
Y = UnitY(Factor=1)
Z_2 = UnitZ(Factor=1)
X = UnitX(Factor=1)
angle = Angle(VectorA=rotax.Geometry, VectorB=X)  # -> Angle, Reflex
angle_2 = Angle(VectorA=rotax.Geometry, VectorB=Y)  # -> Angle, Reflex
angle_3 = Angle(VectorA=rotax.Geometry, VectorB=Z_2)  # -> Angle, Reflex
deg = Degrees(Radians=angle.Angle)  # -> expr("round(x)", Degrees)
deg_2 = Degrees(Radians=angle_2.Angle)  # -> expr("round(x)", Degrees)
deg_3 = Degrees(Radians=angle_3.Angle)  # -> expr("round(x)", Degrees)

line_2 = CherryPicker(ln, ListIndex=1)
addition_2 = Addition(A=deg_3, B=_180)

# ----
# FORMAT WALLS MOVEMENT PYTHON
deconstruct = Deconstruct(Point=divide_2.Points)  # -> XComponent, YComponent, ZComponent
gcode_formatter_4 = Expression(
    e=speed,
    x=deconstruct.XComponent,
    y=deconstruct.YComponent,
    z=deconstruct.ZComponent,
    pitch=deg,
    yaw=deg_2,
    roll=addition_2,
    Expression="Format(\"arm.set_position(x={0:0.00}, y={1:0.00}, z={2:0.00}, roll={3:0.00}, pitch={4:0.00}, yaw={5:0.00}, speed={6:0.00}, is_radian=False, wait=True)\", x, y, z, roll, pitch, yaw, e)")  # -> flatten(Result)
object_code = Panel(gcode_formatter_4)

# ----
# MOVE LENGTH
num = Number(segment_length)

# ----
# EXTRUSION STEPS
# EXTRUSION VOLUME
# ESPEED
# extruder steps
# per second
# armspeed per second
# extrusion per step
# STEPS
flip_points = FlipMatrix(Data=divide_2.Points)
extrusion_width_2 = Integer(extrusion_width)
shift_list_2 = ShiftList(List=flip_points, Shift=1, Wrap=False)
line_3 = Line(StartPoint=flip_points, EndPoint=shift_list_2)  # -> simplify(Line)
length = Length(Curve=line_3)
midpt = CurveMiddle(Curve=line_3)
lng_2 = ListLength(List=midpt)
division_4 = Division(A=length, B=2)
division_5 = Division(A=extrusion_width_2, B=2)
repeat_3 = RepeatData(Data=division_5, Length=lng_2)
ellipse_2 = Ellipse(Plane=midpt, Radius1=repeat_3, Radius2=division_4)  # -> Ellipse, Focus1, Focus2
flip = FlipMatrix(Data=ellipse_2.Ellipse)
lng_3 = ListLength(List=flip)
areamult = RepeatData(Data=area_mult, Length=lng_3)
extr_area = Area(Geometry=flip)  # -> Area, Centroid
multiplication = Multiplication(A=extr_area.Area, B=areamult)
steps_per_mm_extrusion = Expression(BRL=number_2, PIT=_7, STP=_200, A_NOZ=_1, Expression="((BRL*PIT)/STP)/A_NOZ")
division_6 = Division(Armspeed=speed_3, _60=60)
lng_4 = ListLength(List=num)
extrusion_volume = Multiplication(Area=multiplication, Length=num)
repeat_4 = RepeatData(Data=steps_per_mm_extrusion, Length=lng_4)
repeat_5 = RepeatData(Data=division_6, Length=lng_4)
divide_3 = Division(Volume2extrude=simplify(extrusion_volume), Mm3PerStep=simplify(repeat_4))
round = Round(Number=divide_3)  # -> Nearest, Floor, Ceiling
division_7 = Division(A=round.Nearest, B=repeat_5)  # -> simplify(Result)

height = CherryPicker(line_3, ListIndex=1)
ellipse_3 = CherryPicker(flip, ListIndex=1)
panel_5 = Panel(extr_area.Area)
panel_6 = Panel(division_7)
panel_7 = Panel(round.Nearest)

# ----
# HEX CONVERTERS
big_endian_2 = BooleanToggle(True)
move_3 = GhPythonScript(x=round.Nearest, big=big_endian_2)  # -> out, a
# ---------- move_3: Python ----------
__author__ = "morr0289"
__version__ = "2023.07.05"

import rhinoscriptsyntax as rs
import math


z = int (x * 1)
h = str(hex(z))
s = h.lstrip("0x")
e = s.zfill(4)
if big:
    f = e[0]
    g = e[1]
    h = e[2]
    i = e[3]
else:
    f = e[2]
    g = e[3]
    h = e[0]
    i = e[1]
j = "0x"
k = ","
a = j+f+g+k+j+h+i
# ---------- end move_3 ----------
speed_5 = GhPythonScript(x=division_7, big=big_endian_2)  # -> out, a; same code as move_3

# ----
# LINES
lng_5 = ListLength(List=gcode_formatter_4)
int_4 = Integer(1)
series = Series(Start=0, Step=int_4, Count=lng_5)

# ----
# HEX CONVERTERS
big_endian_3 = BooleanToggle(True)
line_4 = GhPythonScript(x=series, big=big_endian_3)  # -> out, a, b; same code as speed_4

# ----
# FORMAT EXTRUSION PYTHON
direction = Panel("0x00,0x01")
slave_id = Panel("0x09")
line_5 = Text(line_4.a)
move_4 = Text(move_3.a)
speed_6 = Text(speed_5.a)
gcode_formatter_5 = Expression(
    slaveid=slave_id,
    move=flatten(move_4),
    speed=flatten(speed_6),
    dir=direction,
    line=line_5,
    Expression="Format(\"datas = [{0},0x10,0x00,0x00,0x00,0x05,0x0a,{1},{2},{3},{4},0x00,0x00]\",slaveid, line, move, speed, dir)")
function_line = Panel("sender(datas)")
tab = Panel("\t")
lng_6 = ListLength(List=gcode_formatter_5)
txt = Text(tab)
repeat_6 = RepeatData(Data=function_line, Length=lng_6)
lng_7 = ListLength(List=gcode_formatter_5)
repeat_7 = RepeatData(Data="arm.clean_error()", Length=lng_7)
weave_5 = Weave(
    Pattern=[3, 1, 2, 0],
    Stream0=gcode_formatter_4,
    Stream1=gcode_formatter_5,
    Stream2=repeat_6,
    Stream3=repeat_7,
    NullGaps=False)
concat = Concatenate(FragmentA=txt, FragmentB=weave_5)

# ----
# ASSEMBLE
ip_address = Panel("192.168.1.240")
main_code = Panel("""id = 9
baudRate = 9600

code, digitals = arm.get_tgpio_digital()

if arm.warn_code != 0:
    arm.clean_warn()
if arm.error_code != 0:
    arm.clean_error()
time.sleep(2)

ret = arm.core.set_modbus_timeout(7)  
print('set modbus timeout, ret = %d' % (ret[0]))    
ret = arm.core.set_modbus_baudrate(baudRate)  
print('set modbus baudrate, ret = %d' % (ret[0]))

time.sleep(1)
line = 104

def errors(returned):
    if returned == 1:
        print('1: uncleared error exists')
    elif returned == 23:
        print('23:modbus reply length error')
    elif returned == 20:
        print('20: wrong slave id')
    elif returned == 15:
        print('15: Modbus commands full')
    elif returned == 19:
        print('19: communication error')
    elif returned == 28:
        print('28: end module communication error')
    else:
        print('other error: ',returned)
    input=('clear errors? (y/n)')
    if input == 'y':
            arm.clean_error()
    else:
        print('error not cleared; quitting...')
        time.sleep(2)
        quit()

def sender(data_frame):
    global id
    arm.clean_error()
    time.sleep(.01)
    #while arm.connected and arm.error_code != 19 and arm.error_code != 28:
    if code == 0 and digitals[0] == 1:
        print ('extruder reports ready')
        ret = arm.getset_tgpio_modbus_data(data_frame,host_id=id)
        if ret[0] == 0:
            #print('wrote move: ',data_frame[8],data_frame[9],data_frame[10])
            print('wrote move: ',data_frame[9],data_frame[10])
            print('wrote speed: ',data_frame[11],data_frame[12])
            print('wrote line: ',data_frame[13],data_frame[14])
            print('wrote end: ',data_frame[15],data_frame[16])
            print('got back this: ',ret[1])
            #line += 3
    elif digitals [0] == 0:
        print('extruder reports not ready')
    elif code != 0:
        errors(ret[0])

arm.motion_enable(enable=True)
arm.set_mode(0)
arm.set_state(state=0)

arm.set_tcp_load(weight=0.91, center_of_gravity=[0,80,-40]) 
arm.set_tcp_offset([0,0,111.5,0,30.3,0], is_radian=False)
arm.set_collision_tool_model(22, x=40, y=40, z=111.5)

last_digitals = [-1, -1]

'''TGPIO for air solenoid---------------------------------------------
value = 0

    code = arm.set_cgpio_digital_output_function(i, value)
    print('set_cgpio_digital_output_function({}, {}), code={}'.format(i, value, code))
# Reset: 255
for i in range(4, 8):
    code = arm.set_cgpio_digital_output_function(i, 255)
    print('set_cgpio_digital_output_function({}, {}), code={}'.format(i, value, code))'''


arm.reset(wait=True)
if arm.warn_code != 0:
    arm.clean_warn()
if arm.error_code != 0:
    arm.clean_error()
time.sleep(2)

'''datas format: [0x09: slave id,0x10 function 16 write registers,0x00,0x00 beginning address to write,0x00,0x05 number of registers,0x0a number of bytes(2x registers),0x00,0x15 register 0 movement,0x00,0x06 register 1 speed,0x00,0x01 register 2 direction,0x00,0x64 register 3 line number,0x00,0x00 register 4 end of file]'''

while arm.connected:""")
robot_footer = Panel("""#finish up:   
datas =[0x09,0x10,0x00,0x00,0x00,0x05,0x0a,0x00,0x00,0x00,0x00,0x00,0x00,0x00,0x00,0x00,0x01]
sender(datas)
time.sleep(2)
arm.reset(wait=True)
arm.disconnect()""")
heading = Panel("""#generated with Grasshopper for Rhino
#Chris Morrey

import os
import sys
import time
import math

sys.path.append("C:\\Users\\morr0289\\Documents\\Github\\RobotArm\\Python\\")

from ..arm_sdk3.xarm.wrapper.xarm_api import XArmAPI""")
expression = Expression(x=ip_address, Expression="Format(\"arm = XArmAPI('{0}')\", x)")
lng_8 = ListLength(List=main_code)
lng_9 = ListLength(List=heading)
lng_10 = ListLength(List=expression)
code_length = Addition(A=lng_9, B=lng_10, C=lng_8)
top = Merge(Data1=heading, Data2=expression, Data3=main_code)
merge_2 = Merge(Data1=top, Data3=flatten(concat), Data4=flatten(robot_footer))  # -> flatten(Result)
panel_8 = Panel(merge_2)

# ----
# MODBUS LINES ONLY
modonly = Weave(Pattern=[0, 1], NullGaps=False)
concat_2 = Concatenate(FragmentB=modonly)
merge_3 = Merge(Data1=simplify(flatten(top)), Data2=simplify(flatten(concat_2)), Data3=simplify(flatten(robot_footer)))
panel_9 = Panel(merge_3)

# ----
# MODBUS LINES SHORT
subset_2 = SubList(List=merge_3, Domain=[Domain(0, 301), Domain(9706, 9711)], Wrap=False)  # -> List, Index
panel_10 = Panel(subset_2.List)

# ----
# FULL CODE SHORT
panel_11 = Panel("0 to 301")
subset_3 = SubList(List=merge_2, Domain=panel_11, Wrap=False)  # -> flatten(List), Index
merge_4 = Merge(Data1=subset_3.List, Data2=robot_footer)
panel_12 = Panel(merge_4)

# ----
# FORMAT TO EXCEL
yaw = Number(deg_2)
roll = Number(addition_2)
pitch = Number(deg)
points = Point(divide_2.Points)
lng_11 = ListLength(List=speed_5.a)
repeat_8 = RepeatData(Data=direction, Length=lng_11)
lng_12 = ListLength(List=flatten(round.Nearest))
repeat_9 = RepeatData(Data="0x00,0x00", Length=lng_11)
series_2 = Series(Start=1, Step=1, Count=lng_12)
gcode_formatter_6 = Expression(
    index=line_4.a,
    move=move_3.a,
    speed=speed_5.a,
    dir=repeat_8,
    line=line_4.a,
    end=repeat_9,
    Expression="Format(\"{0},{1},{2},{3},{4}\",line,move,speed,dir,end)")
line_6 = Number(series_2)
lng_13 = ListLength(List=flatten(line_6))
pdecon = Deconstruct(Point=points)  # -> XComponent, YComponent, ZComponent
roll_2 = RepeatData(Data=-180, Length=lng_13)
fspeed = RepeatData(Data=speed_2, Length=lng_13)
yaw_2 = RepeatData(Data=0, Length=lng_13)
pitch_2 = RepeatData(Data=0, Length=lng_13)
dir = RepeatData(Data=1, Length=lng_13)
panel_13 = Panel(gcode_formatter_6)
multiplication_2 = Multiplication(A=250, B=13)
panel_14 = Panel("""index
line
move
espeed
direction
end
x
y
z
pitch
roll
yaw
fspeed""")
subtraction = Subtraction(A=multiplication_2, B=1)
clr_formats = BooleanToggle(True)
clr_values = BooleanToggle(False)
dom = ConstructDomain(DomainStart=0, DomainEnd=subtraction)
write_3 = BooleanToggle(False)
save = BooleanToggle(True)
xl_settings = ExcelSettings(ClearValues=clr_values, ClearFormatting=clr_formats, Save=save, Close=Toggle(False))
panel_15 = Panel("C:\Users\morr0289\Documents\GitHub\RobotArm\Python\final\grassDataWalls.xlsx")
panel_16 = Panel("C:\Users\morr0289\Documents\Repositories\GitHub\RobotArm\Python\final\armFinal\data_here\grassDataWallsShort.xlsx")

subtraction_2 = Subtraction(A=lng_13, B=1)

end = RepeatData(Data=0, Length=subtraction_2)

ins = InsertItems(List=end, Item=_1_2, Indices=subtraction_2, Wrap=False)

weave_6 = Weave(
    Pattern=[0, 1, 2, 3, 4, 5, 6, 7, 8, 9, 10, 11, 12],
    Stream0=line_6,
    Stream1=line_6,
    Stream2=flatten(round.Nearest),
    Stream3=flatten(division_7),
    Stream4=dir,
    Stream5=flatten(ins),
    Stream6=flatten(pdecon.XComponent),
    Stream7=flatten(pdecon.YComponent),
    Stream8=flatten(pdecon.ZComponent),
    Stream9=pitch_2,
    Stream10=roll_2,
    Stream11=yaw_2,
    Stream12=fspeed,
    NullGaps=False)
partition = PartitionList(List=weave_6, Size=13)  # -> simplify(Chunks)
subset_4 = SubList(List=weave_6, Domain=dom, Wrap=False)  # -> List, Index
xl_out = WriteToExcelClassic(WorkbookFilepath=panel_15, WorksheetName="1", Data=partition, LocationAddress="A2", Settings=xl_settings, Stream=write_3)
panel_17 = Panel(partition)

add_end_bit = ReplaceItems(List=subset_4.List, Item=1, Indices=int_3, Wrap=False)

partition_2 = PartitionList(List=add_end_bit, Size=13)  # -> simplify(Chunks)
xl_out_2 = WriteToExcelClassic(
    WorkbookFilepath=panel_16,
    WorksheetName="1",
    Data=partition_2,
    LocationAddress="A2",
    Settings=xl_settings,
    Stream=write_2)
panel_18 = Panel(partition_2)
