# Grasshopper definition xArm6core_drawText.gh (Grasshopper 1.0.7)
# plug-ins: LunchBox, CORE.Toolbox.Grasshopper

# ----
# SETTINGS
# EXTRUSION WIDTH
extrusion_width = Slider(2.55, range=1..5)

# ----
# EXTRUDER ANGLE
extruder_angle = Slider(120, range=0..180)

# ----
# NUM CURVE POINTS
curve_points = Slider(1, range=1..200)

# ----
# X POSITION
_400 = Integer(400)

# ----
# ARM SPEED
speed = Number(300)

# ----
# Y POSITION
_0 = Integer(0)

# ----
# LAYER HEIGHT
number = Number(1.85)

crv = Curve([<curve referenced from the Rhino model> x79])

# ----
# MOVE
addition = Addition()
vec = VectorXYZ(XComponent=_400, YComponent=_0, ZComponent=addition)  # -> Vector, Length
move_up_and_to_cartesian = Move(Motion=vec.Vector)  # -> Geometry, Transform

# ----
# CURVES INTO POINTS
divide = DivideCurve(Curve=reparameterize(crv), Count=curve_points, Kinks=True)  # -> Points, flatten(Tangents), Parameters

end = EndPoints(Curve=crv)  # -> Start, End

# ----
# EXTRUSION SPEED MULTIPLIER
layer_ht = Number(number)
flip = FlipMatrix(Data=divide.Points)
shift_list = ShiftList(List=flip, Shift=1, Wrap=False)
line = Line(StartPoint=flip, EndPoint=shift_list)  # -> simplify(Line)
length = Length(Curve=line)
division = Division(A=length, B=layer_ht)
flip_2 = FlipMatrix(Data=division)

# ----
# SEGMENT LENGTH
shift_list_2 = ShiftList(List=divide.Points, Shift=1, Wrap=True)
ln = Line(StartPoint=divide.Points, EndPoint=shift_list_2)
len = Length(Curve=ln)
segment_length = Expression(x=len, Expression="Format(\"{0:0.00}\",x)")

arm_mm_sec = Division(A=speed, B=60)

# ----
# PITCH YAW ROLL
pframe = PerpFrame(Curve=graft(move_up_and_to_cartesian.Geometry), Parameter=divide.Parameters)
deplane = DeconstructPlane(Plane=pframe)  # -> Origin, XAxis, YAxis, ZAxis
rev = Reverse(Vector=deplane.XAxis)
rad = Radians(Degrees=extruder_angle)
line_2 = LineSDL(Start=deplane.Origin, Direction=rev, Length=1)
rotax = RotateAxis(Geometry=ln, Angle=rad, Axis=line_2)  # -> Geometry, Transform
Y = UnitY(Factor=1)
X = UnitX(Factor=1)
Z = UnitZ(Factor=1)
angle = Angle(VectorA=rotax.Geometry, VectorB=X)  # -> Angle, Reflex
angle_2 = Angle(VectorA=rotax.Geometry, VectorB=Y)  # -> Angle, Reflex
angle_3 = Angle(VectorA=rotax.Geometry, VectorB=Z)  # -> Angle, Reflex
deg = Degrees(Radians=angle.Angle)  # -> expr("round(x)", Degrees)
deg_2 = Degrees(Radians=angle_3.Angle)  # -> expr("round(x)", Degrees)
deg_3 = Degrees(Radians=angle_2.Angle)  # -> expr("round(x)", Degrees)

# ----
# NOZZLE RADIUS
_1 = Number(expr("x²*π", 1))

# ----
# MOVEMENT
num = Number(segment_length)

# ----
# BARREL AREA
number_2 = Number(75.39)  # "75.39"

# ----
# STEPS PER ROTATION
_200 = Integer(200)

# ----
# AUGER PITCH
_7 = Integer(7)

# ----
# LAYER MULTIPLIER
num_2 = Number(flip_2)

# ----
# BASE SPEED
speed_2 = Integer(speed)

# ----
# EXTRUSION
steps_per_mm_extrusion = Expression(BRL=number_2, PIT=_7, STP=_200, A_NOZ=_1, Expression="((BRL*PIT)/STP)/A_NOZ")
lng = ListLength(List=num)
lng_2 = ListLength(List=num_2)
repeat = RepeatData(Data=steps_per_mm_extrusion, Length=lng)
extrusion_move = Multiplication(A=repeat, B=num, C=num_2)  # -> simplify(Result)
repeat_2 = RepeatData(Data=speed_2, Length=lng_2)

# ----
# WALLS MOVEMENT PYTHON
deconstruct = Deconstruct(Point=divide.Points)  # -> XComponent, YComponent, ZComponent
gcode_formatter = Expression(
    e=speed,
    x=deconstruct.XComponent,
    y=deconstruct.YComponent,
    z=deconstruct.ZComponent,
    pitch=deg,
    yaw=deg_3,
    roll=deg_2,
    Expression="Format(\"arm.set_position(x={0:0.00}, y={1:0.00}, z={2:0.00}, roll={3:0.00}, pitch={4:0.00}, yaw={5:0.00}, speed={6:0.00}, is_radian=False, wait=True)\", x, y, z, roll, pitch, yaw, e)")  # -> flatten(Result)
object_code = Panel(gcode_formatter)

division_2 = Division(A=arm_mm_sec, B=steps_per_mm_extrusion)
panel = Panel(extrusion_move)
int = Integer(division_2)

# ----
# HEX CONVERTERS
big_endian = BooleanToggle(True)
move = GhPythonScript(x=extrusion_move, big=big_endian)  # -> out, a
# ---------- move: Python ----------
__author__ = "morr0289"
__version__ = "2023.07.05"

import rhinoscriptsyntax as rs
import math


z = int (x * 1)
h = str(hex(z))
s = h.lstrip("0x")
e = s.zfill(4)
if big:
    f = e[0]
    g = e[1]
    h = e[2]
    i = e[3]
else:
    f = e[2]
    g = e[3]
    h = e[0]
    i = e[1]
j = "0x"
k = ","
a = j+f+g+k+j+h+i
# ---------- end move ----------
speed_3 = GhPythonScript(x=repeat_2, big=big_endian)  # -> out, a; same code as move

# ----
# BASE POINTS
# MAKE JUMP
explode = Explode(Recursive=True)  # -> Segments, Vertices
end_2 = EndPoints(Curve=explode.Segments)  # -> Start, End
len_2 = Length(Curve=explode.Segments)

panel_2 = Panel(len_2)

# ----
# HEX CONVERTERS
big_endian_2 = BooleanToggle(True)
speed_4 = GhPythonScript(x=int, big=big_endian_2)  # -> out, a, b
# ---------- speed_4: Python ----------
__author__ = "morr0289"
__version__ = "2023.07.05"

import rhinoscriptsyntax as rs
import math
z = int(x*1)
h = str(hex(z))
s = h.lstrip("0x")
e = s.zfill(4)
if big:
    f = e[0]
    g = e[1]
    h = e[2]
    i = e[3]
else:
    f = e[2]
    g = e[3]
    h = e[0]
    i = e[1]
j = "0x"
k = ","
a = j+f+g+k+j+h+i
b=z
# ---------- end speed_4 ----------

# ----
# modbus comments
# data subset with comments for debugging
panel_3 = Panel(speed_4.b)
panel_4 = Panel()
lng_3 = ListLength(List=flatten(panel_3))
int_2 = Integer(9)
repeat_3 = RepeatData(Data="0x00,0x01", Length=lng_3)
int_3 = Integer(1)
gcode_formatter_2 = Expression(speed=flatten(speed_4.a), dir=repeat_3, Expression="Format(\"{0},{1},{2}\",move, speed, dir)")
gcode_formatter_3 = Expression(
    slaveid=int_2,
    move=flatten(panel_4),
    speed=flatten(panel_3),
    Expression="Format(\"#datas = [{0},func16,start1,start2,numreg1,numreg2,numbytes,{1},{2},0x00,{3}]\",slaveid, move, speed, dir)")
repeat_4 = RepeatData(Data=int_3, Length=lng_3)
gcode_formatter_4 = Expression(move=flatten(panel_4), speed=flatten(panel_3), dir=repeat_4, Expression="Format(\"{0},{1},{2}\",move, speed, dir)")
csv = CreateCSV(DataGridHeaders="move1,move2,speed1,speed2,dir1,dir2", ValueTree=gcode_formatter_2, Delimiter=",")
panel_5 = Panel(gcode_formatter_2)
relative = BooleanToggle(False)
overwrite = BooleanToggle(True)
write = BooleanToggle(True)
path = FilePath("C:\Users\morr0289\Documents\GitHub\RobotArm\Python\programs\ext_data.txt")
txt_writer = TextDocumentWriter(relative=relative, file=path, lines=gcode_formatter_4, write=write, overwrite=overwrite)  # inputs relative: Boolean, lines: list, write: Boolean, overwrite: Boolean, append: Boolean
# ---------- txt_writer: Python ----------
"""
Writes to a TXT or CSV file.
    Inputs:
        relative: Set to 'True' to create a new Text File using relative path. This file will live in the same directory as the Grasshopper document.
        file: TXT or CSV file to write to.
        lines: Text to write.
        write: Set to True to write.
        overwrite: Set to True to overwrite the specified file.
        append: Set to True to append the specified file.
"""

# Stephen P. Maher /  2015

ghenv.Component.Name = "Text Document Writer"
ghenv.Component.NickName = 'TXT-Writer'

import Grasshopper as gh
import os

if not relative and not file:
    msg = "Set either 'relative' to True or connect a file path to input parameter 'file'."
    ghenv.Component.AddRuntimeMessage(gh.Kernel.GH_RuntimeMessageLevel.Warning, msg)
elif relative == True:
    if overwrite == True and append == True:
        msg = "Set either 'overwrite' or 'append' to True."
        ghenv.Component.AddRuntimeMessage(gh.Kernel.GH_RuntimeMessageLevel.Error, msg)
    elif write:
        gh_path = ghdoc.Path # Get GH document's file path
        name = gh_path.split(".")[0]
        new = name.split("\\")
        file_name = new[4] + "_text_file.txt" # Create text file name
        dir = os.path.dirname(os.path.realpath(gh_path))
        file = os.path.join(dir, file_name) # Create text file path
        filePath = open(file, "w") # Open text file to create it
        if os.stat(file).st_size == 0: # Check to see if file has any data and continue if it's empty
            filePath = open(file, "w") # Open the file
            for line in lines: # Iterate through lines
                filePath.write(line + "\n") # Write separate lines
            filePath.close() # Close the file
        elif os.stat(file).st_size >= 1 and overwrite == False and append == False: # Check if file has data; if it does and 'overwrite' is  set to False, warn the user
            msg = "This file has content. If you wish to overwrite or append the file, please set either input parameters 'overwrite' or 'append' to True."
            ghenv.Component.AddRuntimeMessage(gh.Kernel.GH_RuntimeMessageLevel.Error, msg)
        elif os.stat(file).st_size >= 1 and overwrite == True: # If file has data and 'overwrite' set to True continue
            filePath = open(file, "w") # Open the file
            for line in lines: # Iterate through lines
                filePath.write(line + "\n") # Write separate lines
            filePath.close() # Close the file
        elif os.stat(file).st_size >= 1 and append == True: # If file has data and 'append' set to True and 'overwrite set to False  continue
            filePath = open(file, "a") # Open the file and 'append' document
            for line in lines: # Iterate through lines
                filePath.write("\n" + line) # Write separate lines
            filePath.close() # Close the file
    else:
        msg = "Set 'write' to True."
        ghenv.Component.AddRuntimeMessage(gh.Kernel.GH_RuntimeMessageLevel.Warning, msg)
elif relative == False or not relative:
    open(file, "w")
    if file:
        if overwrite == True and append == True:
            msg = "Set either 'overwrite' or 'append' to True."
            ghenv.Component.AddRuntimeMessage(gh.Kernel.GH_RuntimeMessageLevel.Error, msg)
        elif write:
            if os.stat(file).st_size == 0: # Check to see if file has any data and continue if it's empty
                filePath = open(file, "w") # Open the file
                for line in lines: # Iterate through lines
                    filePath.write(line + "\n") # Write separate lines
                filePath.close() # Close the file
            elif os.stat(file).st_size >= 1 and overwrite == False and append == False: # Check if file has data; if it does and 'overwrite' is  set to False, warn the user
                msg = "This file has content. If you wish to overwrite or append the file, please set either input parameters 'overwrite' or 'append' to True."
                ghenv.Component.AddRuntimeMessage(gh.Kernel.GH_RuntimeMessageLevel.Error, msg)
            elif os.stat(file).st_size >= 1 and overwrite == True: # If file has data and 'overwrite' set to True continue
                filePath = open(file, "w") # Open the file
                for line in lines: # Iterate through lines
                    filePath.write(line + "\n") # Write separate lines
                filePath.close() # Close the file
            elif os.stat(file).st_size >= 1 and append == True: # If file has data and 'append' set to True and 'overwrite set to False  continue
                filePath = open(file, "a") # Open the file and 'append' document
                for line in lines: # Iterate through lines
                    filePath.write("\n" + line) # Write separate lines
                filePath.close() # Close the file
        else:
            msg = "Set 'write' to True."
            ghenv.Component.AddRuntimeMessage(gh.Kernel.GH_RuntimeMessageLevel.Warning, msg)
    else:
        msg = "Input parameter 'file' failed to collect data."
        ghenv.Component.AddRuntimeMessage(gh.Kernel.GH_RuntimeMessageLevel.Warning, msg)
# ---------- end txt_writer ----------
weave = Weave(Pattern=[1, 2, 0], Stream2=gcode_formatter_3, NullGaps=False)
subset = SubList(List=weave, Domain="0 to 89", Wrap=True)  # -> List, Index
panel_6 = Panel(subset.List)

toggle = BooleanToggle(False)

# ----
# HEX CONVERTERS
big_endian_3 = BooleanToggle(True)

# ----
# LINES
lng_4 = ListLength(List=gcode_formatter)
int_4 = Integer(3)

# ----
# FORMAT EXTRUSION FOR MODBUS
direction = Panel("0x00,0x01")
slave_id = Panel("0x09")
move_2 = Text(move.a)
speed_5 = Text(speed_3.a)
function_line = Panel("sender(datas)")
tab = Panel("\t")
txt = Text(tab)

# ----
# TO EXCEL
panel_7 = Panel("0x00,0x00")
merge = Merge(Data2=flatten(speed_3.a))
lng_5 = ListLength(List=merge)
repeat_5 = RepeatData(Data=panel_7, Length=lng_5)
line_3 = Number()
repeat_6 = RepeatData(Data=direction, Length=lng_5)
lng_6 = ListLength(List=flatten(line_3))
series = Series(Start=0, Step=1, Count=lng_6)
speed_6 = Number(int)
move_3 = Number(len_2)
repeat_7 = RepeatData(Data=speed_6, Length=lng_6)
repeat_8 = RepeatData(Data=1, Length=lng_6)
repeat_9 = RepeatData(Data=0, Length=lng_6)
repeat_10 = RepeatData(Data=0, Length=lng_6)
repeat_11 = RepeatData(Data=0, Length=lng_6)
repeat_12 = RepeatData(Data=0, Length=lng_6)
repeat_13 = RepeatData(Data=300, Length=lng_6)
expression = Expression(x=move_3, Expression="Round(x,0)")  # -> flatten(R)
weave_2 = Weave(
    Pattern=[0, 1, 2, 3, 4, 5, 6, 7, 8, 9, 10, 11],
    Stream0=line_3,
    Stream1=flatten(expression),
    Stream2=repeat_7,
    Stream3=repeat_8,
    Stream4=repeat_9,
    Stream8=repeat_10,
    Stream9=repeat_12,
    Stream10=repeat_11,
    Stream11=repeat_13,
    NullGaps=False)
partition = PartitionList(List=weave_2, Size=12)
write_2 = BooleanToggle(False)
clr_values = BooleanToggle(False)
clr_formats = BooleanToggle(True)
save = BooleanToggle(True)
panel_8 = Panel("""line
move
espeed
direction
end
x
y
z
pitch
yaw
roll
fspeed""")
panel_9 = Panel("C:\Users\morr0289\Documents\GitHub\RobotArm\Python\final\textData.xlsx")
xl_settings = ExcelSettings(ClearValues=clr_values, ClearFormatting=clr_formats, Save=save, Close=Toggle(False))
xl_out = WriteToExcelClassic(
    WorkbookFilepath=panel_9,
    WorksheetName="1",
    Data=simplify(partition),
    LocationAddress="A2",
    Settings=xl_settings,
    Stream=write_2)
panel_10 = Panel(partition)

ip_address = Panel("192.168.1.240")
main_code = Panel("""id = 9
baudRate = 9600

code, digitals = arm.get_tgpio_digital()

if arm.warn_code != 0:
    arm.clean_warn()
if arm.error_code != 0:
    arm.clean_error()
time.sleep(2)

ret = arm.core.set_modbus_timeout(7)  
print('set modbus timeout, ret = %d' % (ret[0]))    
ret = arm.core.set_modbus_baudrate(baudRate)  
print('set modbus baudrate, ret = %d' % (ret[0]))

time.sleep(1)
line = 104

def errors(returned):
    if returned == 1:
        print('1: uncleared error exists')
    elif returned == 23:
        print('23:modbus reply length error')
    elif returned == 20:
        print('20: wrong slave id')
    elif returned == 15:
        print('15: Modbus commands full')
    elif returned == 19:
        print('19: communication error')
    elif returned == 28:
        print('28: end module communication error')
    else:
        print('other error: ',returned)
    input=('clear errors? (y/n)')
    if input == 'y':
            arm.clean_error()
    else:
        print('error not cleared; quitting...')
        time.sleep(2)
        quit()

def sender(data_frame):
    global id
    arm.clean_error()
    time.sleep(.01)
    #while arm.connected and arm.error_code != 19 and arm.error_code != 28:
    if code == 0 and digitals[0] == 1:
        print ('extruder reports ready')
        ret = arm.getset_tgpio_modbus_data(data_frame,host_id=id)
        if ret[0] == 0:
            #print('wrote move: ',data_frame[8],data_frame[9],data_frame[10])
            print('wrote move: ',data_frame[9],data_frame[10])
            print('wrote speed: ',data_frame[11],data_frame[12])
            print('wrote line: ',data_frame[13],data_frame[14])
            print('wrote end: ',data_frame[15],data_frame[16])
            print('got back this: ',ret[1])
            #line += 3
    elif digitals [0] == 0:
        print('extruder reports not ready')
    elif code != 0:
        errors(ret[0])

arm.motion_enable(enable=True)
arm.set_mode(0)
arm.set_state(state=0)

arm.set_tcp_load(weight=0.91, center_of_gravity=[0,80,-40]) 
arm.set_tcp_offset([0,0,111.5,0,30.3,0], is_radian=False)
arm.set_collision_tool_model(22, x=40, y=40, z=111.5)

last_digitals = [-1, -1]

'''TGPIO for air solenoid---------------------------------------------
value = 0

    code = arm.set_cgpio_digital_output_function(i, value)
    print('set_cgpio_digital_output_function({}, {}), code={}'.format(i, value, code))
# Reset: 255
for i in range(4, 8):
    code = arm.set_cgpio_digital_output_function(i, 255)
    print('set_cgpio_digital_output_function({}, {}), code={}'.format(i, value, code))'''


arm.reset(wait=True)
if arm.warn_code != 0:
    arm.clean_warn()
if arm.error_code != 0:
    arm.clean_error()
time.sleep(2)

'''datas format: [0x09: slave id,0x10 function 16 write registers,0x00,0x00 beginning address to write,0x00,0x05 number of registers,0x0a number of bytes(2x registers),0x00,0x15 register 0 movement,0x00,0x06 register 1 speed,0x00,0x01 register 2 direction,0x00,0x64 register 3 line number,0x00,0x00 register 4 end of file]'''

while arm.connected:""")
robot_footer = Panel("""#finish up:   
datas =[0x09,0x10,0x00,0x00,0x00,0x05,0x0a,0x00,0x00,0x00,0x00,0x00,0x00,0x00,0x00,0x00,0x01]
sender(datas)
time.sleep(2)
arm.reset(wait=True)
arm.disconnect()""")
heading = Panel("""#generated with Grasshopper for Rhino
#Chris Morrey

import os
import sys
import time
import math

sys.path.append("C:\\Users\\morr0289\\Documents\\Github\\RobotArm\\Python\\")

from ..arm_sdk3.xarm.wrapper.xarm_api import XArmAPI""")
bases = Relay()
expression_2 = Expression(x=ip_address, Expression="Format(\"arm = XArmAPI('{0}')\", x)")
lng_7 = ListLength(List=main_code)
lng_8 = ListLength(List=heading)
lng_9 = ListLength(List=expression_2)
code_length = Addition(A=lng_8, B=lng_9, C=lng_7)
top = Merge(Data1=heading, Data2=expression_2, Data3=main_code)

addition_2 = Addition(A=code_length)
series_2 = Series(Start=addition_2, Step=int_4, Count=lng_4)

line_4 = GhPythonScript(x=series_2, big=big_endian_3)  # -> out, a, b; same code as speed_4

line_5 = Text(line_4.a)
gcode_formatter_5 = Expression(
    slaveid=slave_id,
    move=flatten(move_2),
    speed=flatten(speed_5),
    dir=direction,
    line=line_5,
    Expression="Format(\"datas = [{0},0x10,0x00,0x00,0x00,0x05,0x0a,{1},{2},{3},{4},0x00,0x00]\",slaveid, line, move, speed, dir)")
lng_10 = ListLength(List=gcode_formatter_5)
repeat_14 = RepeatData(Data=function_line, Length=lng_10)
weave_3 = Weave(Pattern=[0, 1, 2], Stream0=gcode_formatter, Stream1=gcode_formatter_5, Stream2=repeat_14, NullGaps=False)
concat = Concatenate(FragmentA=txt, FragmentB=weave_3)

gcode_formatter_6 = Expression(
    move=flatten(move.a),
    speed=merge,
    dir=repeat_6,
    line=line_4.a,
    end=repeat_5,
    Expression="Format(\"{0},{1},{2},{3},{4}\",line,move,speed,dir,end)")
panel_11 = Panel(gcode_formatter_6)
panel_12 = Panel(panel_11)

merge_2 = Merge(Data1=top, Data2=flatten(bases), Data3=flatten(concat), Data4=flatten(robot_footer))  # -> flatten(Result)
panel_13 = Panel(merge_2)

subset_2 = SubList(List=merge_2, Domain="0 to 301", Wrap=False)  # -> flatten(List), Index
merge_3 = Merge(Data1=subset_2.List, Data2=robot_footer)
panel_14 = Panel(merge_3)

# ----
# MODBUS LINES ONLY
modonly = Weave(Pattern=[0, 1], NullGaps=False)
concat_2 = Concatenate(FragmentB=modonly)
merge_4 = Merge(Data1=simplify(flatten(top)), Data2=simplify(flatten(concat_2)), Data3=simplify(flatten(robot_footer)))
panel_15 = Panel(merge_4)

subset_3 = SubList(List=merge_4, Domain=[Domain(0, 301), Domain(9706, 9711)], Wrap=False)  # -> List, Index
panel_16 = Panel(subset_3.List)
