# Grasshopper definition PYgeneratorModOnly.gh (Grasshopper 1.0.7)
# plug-ins: ShapeDiverForGrasshopper

# ----
# EXTRUSION MULTIPLIER
# Configuration recipe
# 
# Index 1: distance to print plate center
# Index 3: Layer Height
extrusion_multiplier = Slider(1.75, range=0..5)

# ----
# CHOOSE EQUIPMENT
value_list = ValueList({"Potterbot": 200, "Xarm6": 300}, selected="Xarm6")
_200 = Integer(value_list)

# ---- group: make 3 curves
# MAKE 3 CURVES
radius_1 = Slider(93, range=20..200)
plane = Plane(PlaneXY(0, 0, 0))
half_height = Slider(35, range=20..200)
curve_height = Slider(25, range=20..200)
ellipse = Ellipse(Plane=plane, Radius1=radius_1, Radius2=Slider(57, range=20..200))  # -> Ellipse, Focus1, Focus2
vec = VectorXYZ(XComponent=Slider(0.154, range=0..1), YComponent=Slider(0, range=0..1), ZComponent=half_height)  # -> Vector, Length
_3 = Integer(3)
arrlinear = LinearArray(Geometry=ellipse.Ellipse, Direction=vec.Vector, Count=_3)  # -> Geometry, Transform
_4 = Integer(4)
integer = Integer([0, 2])
vec_2 = VectorXYZ(XComponent=Slider(0, range=0..1), YComponent=Slider(0, range=0..1), ZComponent=curve_height)  # -> Vector, Length
cull_i = CullIndex(List=arrlinear.Geometry, Indices=integer, Wrap=True)
divide = DivideCurve(Curve=cull_i, Count=_4, Kinks=False)  # -> Points, Tangents, Parameters
integer_2 = Integer([0, 2])
integer_3 = Integer([1, 3])
cull_i_2 = CullIndex(List=divide.Points, Indices=integer_3, Wrap=True)
cull_i_3 = CullIndex(List=divide.Points, Indices=integer_2, Wrap=True)
move = Move(Geometry=cull_i_3, Motion=vec_2.Vector)  # -> Geometry, Transform
integer_4 = Integer(-2)
division = Division(A=curve_height, B=integer_4)
weave = Weave(Pattern=[0, 1], Stream0=cull_i_2, Stream1=move.Geometry, NullGaps=False)
integer_5 = Integer([0, 1])
integer_6 = Integer([1, 2])
Z = UnitZ(Factor=division)
cull_i_4 = CullIndex(List=arrlinear.Geometry, Indices=integer_5, Wrap=True)
cull_i_5 = CullIndex(List=arrlinear.Geometry, Indices=integer_6, Wrap=True)
intcrv = Interpolate(Vertices=weave, Degree=3, Periodic=True, KnotStyle=1)  # -> Curve, Length, Domain
move_2 = Move(Geometry=intcrv.Curve, Motion=Z)  # -> Geometry, Transform
weave_2 = Weave(Pattern=[0, 1], Stream0=move_2.Geometry, Stream1=cull_i_5, NullGaps=False)
weave_3 = Weave(Pattern=[0, 1], Stream0=cull_i_4, Stream1=move_2.Geometry, NullGaps=False)

# ----
# BASE LAYER HEIGHT
num = Number(1.6)

xarm_config = Panel("""xArm Configuration
300
Layer Height:
1.6""")
potterbot_config = Panel("""Potterbot Configuration
250
Layer Height:
1.6""")
pick_n_choose = PickNChoose(Pattern=value_list, Stream0=xarm_config, Stream1=potterbot_config)
sddb = ShapeDiverDatabase({AbsoluteTolerance=0, AngleTolerance=0, AppDescription="", AppName="dbl_iso_based_PY2", DocumentName="dbl_iso_based_PY2*", InputGroups="{}", OutputGroups="{\"5f137f3f-7b3f-4e17-becb-d69b9a71ffec\":{\"name\":\"ShapeDiver Output\",\"guid\":\"5f137f3f-7b3f-4e17-becb-d69b9a71ffec\",\"index\":0,\"params\":[],\"indexFloor\":0,\"indexCeiling\":-1}}", RelativeTolerance=0, UnitSystem=0})
addition = Addition(A=num, B=num)
line = Line(StartPoint=ellipse.Focus1, EndPoint=ellipse.Focus2)
curve_middle = CurveMiddle(Curve=line)
value_list_2 = ValueList({"GO": 0, "STOP": 1}, selected="GO")
stream_gate = StreamGate(Stream=extrusion_multiplier, Gate=value_list_2)  # -> Target0, Target1
stream_gate_2 = StreamGate(Stream=_200, Gate=value_list_2)  # -> Target0, Target1
stream_gate_3 = StreamGate(Stream=curve_middle, Gate=value_list_2)  # -> Target0, Target1
value_list_3 = ValueList({"GO": 0, "STOP": 1}, selected="GO")
move_3 = GhPythonScript()  # -> out, a
# ---------- move_3: Python ----------
__author__ = "morr0289"
__version__ = "2023.07.05"

import rhinoscriptsyntax as rs
import math


z = int (x * 100)
h = str(hex(z))
s = h.lstrip("0x")
e = s.zfill(4)
if big:
    f = e[0]
    g = e[1]
    h = e[2]
    i = e[3]
else:
    f = e[2]
    g = e[3]
    h = e[0]
    i = e[1]
j = "0x"
k = ", "
a = j+f+g+k+j+h+i
# ---------- end move_3 ----------
move_4 = GhPythonScript()  # -> out, a; same code as move_3

# ----
# NUMBER OF POINTS
curve_points = Slider(100, range=20..200)

# ----
# MOVEMENT SPEED
extrusion_speed = Number(200)

# ----
# BASE MOVEMENT
number = Number(extrusion_speed)

integer_7 = Integer(1)
integer_8 = Integer(1)
weave_4 = Weave(Pattern=[0, 1], NullGaps=False)
expression = Expression(x="192.168.1.196", Expression="Format(\"arm = XArmAPI('{0}', is_radian=False, do_not_open=False)\", x)")
_1001_move_line_py = Panel("""#code generated with Grasshopper for Rhino at the University of Oklahoma, 
#Gibbs College of Architecture, in the Creating_Making Lab.
#Chris Morrey 9/2023

import math
import os
import struct
import sys
import time

sys.path.append("C:\\Users\\morr0289\\Documents\\Github\\RobotArm\\Python\\")

from arm_sdk2.xarm.wrapper.xarm_api import XArmAPI""")
header3 = Panel("""def sender(*mod):
    code, ret = arm.getset_tgpio_modbus_data([mod[0],mod[1],mod[2],mod[3],mod[4],mod[5],mod[6],mod[7],mod[8],mod[9],mod[10],mod[11]],is_transparent_transmission=True)
    print(mod[0],mod[1],mod[2],mod[3],mod[4],mod[5],mod[6],mod[7],mod[8],mod[9],mod[10],mod[11])

#0x09,0x10,0x00,0xc8,0x00,0x04,0x08,0x00,bytelength,bytespeed



ret = arm.core.set_modbus_baudrate(9600)
print('set modbus baudrate, ret = %d' % (ret[0]))
time.sleep(2)

arm.motion_enable(enable=True)
arm.set_mode(0)

port = 9
arm.set_state(state=0)
arm.reset(wait=True)""")
robot_footer = Panel("""arm.reset(wait=True)
arm.disconnect()""")
merge = Merge(Data1=_1001_move_line_py, Data2=expression, Data3=header3)

extrusion_width = Slider(2.55, range=1..5)
unit_z = UnitZ(Factor=num)
division_2 = Division(A=extrusion_width, B=-2)
offset_curve = OffsetCurve(Curve=ellipse.Ellipse, Distance=division_2, Corners=1)
area = Area(Geometry=offset_curve)  # -> Area, Centroid
crv_cp = CurveClosestPoint(Point=area.Centroid, Curve=offset_curve)  # -> Point, Parameter, Distance
neg = Negative(Value=extrusion_width)
division_3 = Division(A=crv_cp.Distance, B=extrusion_width)
series = Series(Start=0, Step=neg, Count=division_3)
# BASE
offset = OffsetCurve(Curve=offset_curve, Distance=series, Plane=PlaneXY(0, 0, 0), Corners=2)
_40 = Integer(40)
divide_2 = DivideCurve(Curve=offset, Count=_40, Kinks=False)  # -> Points, Tangents, Parameters
flip = FlipMatrix(Data=divide_2.Points)
pline = PolyLine(Vertices=flip, Closed=False)
explode = Explode(Curve=pline, Recursive=True)  # -> Segments, Vertices
end = EndPoints(Curve=explode.Segments)  # -> Start, End
vec2pt = Vector2Pt(PointA=end.Start, PointB=end.End, Unitize=False)  # -> Vector, Length
range = Range(Domain=Domain(0, 1), Steps=expr("X-1", _40))
flip_2 = FlipMatrix(Data=vec2pt.Vector)
multiplication = Multiplication(A=flip_2, B=range)
move_5 = Move(Geometry=divide_2.Points, Motion=multiplication)  # -> flatten(Geometry), Transform
reverse_list = ReverseList(List=move_5.Geometry)
unit_z_2 = UnitZ(Factor=addition)
pline_2 = PolyLine(Vertices=reverse_list, Closed=False)
move_6 = Move(Geometry=pline_2, Motion=unit_z_2)  # -> Geometry, Transform

# ---- group: contour base
X = UnitX(Factor=1)
contour = Contour(Shape=offset_curve, Point=Point(0, 0, 0), Direction=X, Distance=extrusion_width)
dispatch = Dispatch(List=flatten(contour), DispatchPattern=[True, False])  # -> ListA, ListB
list_item = ListItem(List=move_5.Geometry, Index=0, Wrap=True)
flip_3 = FlipCurve(Curve=dispatch.ListB)  # -> Curve, Flag
weave_5 = Weave(Pattern=[0, 1], Stream0=dispatch.ListA, Stream1=flip_3.Curve, NullGaps=False)
disc = Discontinuity(Curve=weave_5, Level=1)  # -> Points, Parameters
closest_point = ClosestPoint(Point=list_item, Cloud=flatten(disc.Points))  # -> ClosestPoint, CPIndex, Distance
shift_list = ShiftList(List=disc.Points, Shift=closest_point.CPIndex, Wrap=True)  # -> flatten(List)
pline_3 = PolyLine(Vertices=shift_list, Closed=False)

# ----
move_7 = Move(Geometry=pline_3, Motion=unit_z)  # -> Geometry, Transform
merge_2 = Merge(Data1=move_7.Geometry, Data2=move_6.Geometry)

stream_gate_4 = StreamGate(Stream=merge_2, Gate=value_list_2)  # -> Target0, Target1

# ----
# MOVE GEOMETRY TO PRINT PLATE
integer_9 = Integer(0)
vec_3 = VectorXYZ(XComponent=stream_gate_2.Target0, YComponent=stream_gate_2.Target0, ZComponent=integer_9)  # -> Vector, Length
move_up_and_to_cartesian = Move(Geometry=stream_gate_4.Target0, Motion=vec_3.Vector)  # -> Geometry, Transform

stream_gate_5 = StreamGate(Stream=move_up_and_to_cartesian.Geometry, Gate=value_list_3)  # -> Target0, Target1

# ----
# BASE POINTS
# Extrusion multiplier
explode_2 = Explode(Curve=stream_gate_5.Target0, Recursive=True)  # -> Segments, Vertices
len = Length(Curve=explode_2.Segments)
multiplication_2 = Multiplication(A=len, B=stream_gate.Target0)

# ----
# TOP ISOCURVES
loft = Loft(Curves=weave_3, Options={Adjust=False, Closed=False, LoftEnds=0, LoftSimp=2, LoftType=0, Rebuild=10, Refit=0.01})
bbox_size_of_object = BoundingBox(Content=weave_3, Plane=PlaneXY(0, 0, 0))  # -> Box, Box_2
debox = DeconstructBox(Box=bbox_size_of_object.Box)  # -> Plane, X, Y, Z
dedomain = DeconstructDomain(Domain=debox.Z)  # -> Start, End
cull_i_6 = CullIndex(List=dedomain.End, Indices=1, Wrap=True)

# ---- group: isocurves
# BOTTOM ISOCURVES
loft_2 = Loft(Curves=weave_2, Options={Adjust=False, Closed=False, LoftEnds=0, LoftSimp=2, LoftType=0, Rebuild=10, Refit=0.01})
bbox_size_of_object_2 = BoundingBox(Content=weave_2, Plane=PlaneXY(0, 0, 0))  # -> Box, Box_2
debox_2 = DeconstructBox(Box=bbox_size_of_object_2.Box)  # -> Plane, X, Y, Z
dedomain_2 = DeconstructDomain(Domain=debox_2.Z)  # -> Start, End

# ----
# WALLS
# WALLS LAYER HEIGHT
layer_height = Number(2.15)

# ---- group: isocurves (continued)
division_4 = Division(A=dedomain_2.End, B=layer_height)
range_2 = Range(Domain=Domain(0, 1), Steps=division_4)
pt = ConstructPoint(XCoordinate=range_2, YCoordinate=0, ZCoordinate=0)
iso = IsoCurve(Surface=reparameterize(loft_2), UVPoint=pt)  # -> UIsocurve, flatten(VIsocurve)
rev = ReverseList(List=iso.VIsocurve)

# ----
division_5 = Division(A=cull_i_6, B=layer_height)
range_3 = Range(Domain=Domain(0, 1), Steps=division_5)
pt_2 = ConstructPoint(XCoordinate=range_3, YCoordinate=0, ZCoordinate=0)
iso_2 = IsoCurve(Surface=reparameterize(loft), UVPoint=pt_2)  # -> UIsocurve, flatten(VIsocurve)
rev_2 = ReverseList(List=iso_2.VIsocurve)

merge_3 = Merge(Data1=rev, Data2=rev_2)

stream_gate_6 = StreamGate(Stream=merge_3, Gate=value_list_2)  # -> Target0, Target1

# ----
# MOVE GEOMETRY TO PRINT PLATE
addition_2 = Addition(A=addition, B=layer_height)
vec_4 = VectorXYZ(XComponent=stream_gate_2.Target0, YComponent=stream_gate_2.Target0, ZComponent=addition_2)  # -> Vector, Length
move_up_and_to_cartesian_2 = Move(Geometry=stream_gate_3.Target0, Motion=vec_4.Vector)  # -> Geometry, Transform

# ----
# MOVE GEOMETRY TO PRINT PLATE
addition_3 = Addition(A=addition, B=layer_height)
vec_5 = VectorXYZ(XComponent=stream_gate_2.Target0, YComponent=stream_gate_2.Target0, ZComponent=addition_3)  # -> Vector, Length
move_up_and_to_cartesian_3 = Move(Geometry=stream_gate_6.Target0, Motion=vec_5.Vector)  # -> Geometry, Transform

stream_gate_7 = StreamGate(Stream=move_up_and_to_cartesian_3.Geometry, Gate=value_list_3)  # -> Target0, Target1
stream_gate_8 = StreamGate(Stream=move_up_and_to_cartesian_2.Geometry, Gate=value_list_3)  # -> Target0, Target1

# ----
# CALCULATE PITCH YAW ROLL
list_length = ListLength(List=stream_gate_7.Target0)
multiplication_3 = Multiplication(A=list_length, B=curve_points)
deconstruct = Deconstruct(Point=stream_gate_8.Target0)  # -> XComponent, YComponent, ZComponent
subtraction = Subtraction(A=multiplication_3, B=curve_points)
series_2 = Series(Start=0, Step=1, Count=curve_points)
series_3 = Series(Start=subtraction, Step=1, Count=curve_points)
addition_4 = Addition(A=deconstruct.ZComponent, B=10)
construct_point = ConstructPoint(XCoordinate=deconstruct.XComponent, YCoordinate=deconstruct.YComponent, ZCoordinate=addition_4)
# xArm6 PYTHON GENERATOR
vector_2pt = Vector2Pt(PointA=construct_point, PointB=stream_gate_8.Target0, Unitize=False)  # -> Vector, Length
integer_10 = Integer(0)

deconstruct_2 = Deconstruct(Point=explode_2.Vertices)  # -> XComponent, YComponent, ZComponent

# ----
# WALL MOVEMENT
divide_3 = DivideCurve(Curve=stream_gate_7.Target0, Count=curve_points, Kinks=False)  # -> Points, Tangents, Parameters
deconstruct_3 = Deconstruct(Point=divide_3.Points)  # -> XComponent, YComponent, ZComponent

list_item_2 = ListItem(List=flatten(divide_3.Points), Index=series_3, Wrap=True)
list_item_3 = ListItem(List=flatten(divide_3.Points), Index=series_2, Wrap=True)
vector_2pt_2 = Vector2Pt(PointA=list_item_3, PointB=list_item_2, Unitize=False)  # -> Vector, Length
angle = Angle(VectorA=vector_2pt_2.Vector, VectorB=vector_2pt.Vector)  # -> Angle, Reflex
degrees = Degrees(Radians=angle.Angle)

gcode_formatter = Expression(
    e=number,
    x=deconstruct_2.XComponent,
    y=deconstruct_2.YComponent,
    z=deconstruct_2.ZComponent,
    pitch=integer_10,
    yaw=integer_10,
    roll=degrees,
    Expression="Format(\"arm.set_position(x={0:0.00}, y={1:0.00}, z={2:0.00}, roll={3:0.00}, pitch={4:0.00}, yaw={5:0.00}, speed={6:0.00}, is_radian=False, wait=True)\", x, y, z, roll, pitch, yaw, e)")  # -> flatten(Result)
base_2_code = Panel(gcode_formatter)

gcode_formatter_2 = Expression(
    e=extrusion_speed,
    x=deconstruct_3.XComponent,
    y=deconstruct_3.YComponent,
    z=deconstruct_3.ZComponent,
    pitch=integer_10,
    yaw=integer_10,
    roll=degrees,
    Expression="Format(\"arm.set_position(x={0:0.00}, y={1:0.00}, z={2:0.00}, roll={3:0.00}, pitch={4:0.00}, yaw={5:0.00}, speed={6:0.00}, is_radian=False, wait=True)\", x, y, z, roll, pitch, yaw, e)")  # -> flatten(Result)

# ----
# EXTRUSION
# SEGMENT LENGTH
shift_list_2 = ShiftList(List=divide_3.Points, Shift=1, Wrap=True)
length_of_segment = Distance(PointA=divide_3.Points, PointB=shift_list_2)  # -> flatten(SegmentLength)

# ----
# EXTRUSION SPEED MULTIPLIER
flip_4 = FlipMatrix(Data=divide_3.Points)
shift_list_3 = ShiftList(List=flip_4, Shift=1, Wrap=False)
line_2 = Line(StartPoint=flip_4, EndPoint=shift_list_3)  # -> simplify(Line)
flip_5 = FlipMatrix(Data=line_2)
length = Length(Curve=flip_5)  # -> flatten(Length)
multiplication_4 = Multiplication(A=length_of_segment, B=length, C=Slider(1, range=0.1..3))

# ----
# SENDER FORMATTING
# MOVE
# SPEED
expression_2 = Expression(x=multiplication_4, Expression="Format(\"{0:0.00}\", x*100)")
expression_3 = Expression(x=length_of_segment, Expression="Format(\"{0:0.00}\", x*100)")
boolean_toggle = BooleanToggle(True)
integer_11 = Integer(simplify(length_of_segment))
integer_12 = Integer(simplify(multiplication_4))
ghpython_script = GhPythonScript(x=flatten(integer_11), big=boolean_toggle)  # -> out, a, b
# ---------- ghpython_script: Python ----------
__author__ = "morr0289"
__version__ = "2023.07.05"

import rhinoscriptsyntax as rs
import math


z = int (x * 100)
h = str(hex(z))
s = h.lstrip("0x")
e = s.zfill(4)
if big:
    f = e[0]
    g = e[1]
    h = e[2]
    i = e[3]
else:
    f = e[2]
    g = e[3]
    h = e[0]
    i = e[1]
j = "0x"
k = ","
a = j+f+g
b = j+h+i
# ---------- end ghpython_script ----------
ghpython_script_2 = GhPythonScript(x=flatten(integer_12), big=boolean_toggle)  # -> out, a, b; same code as ghpython_script

list_length_2 = ListLength(List=flatten(expression_2))
repeat_data = RepeatData(Data=integer_8, Length=list_length_2)

# ----
# BASE EXTRUSION
# SPEED
expression_4 = Expression(x=multiplication_2, Expression="Format(\"{0:0.00}\", x*100)")
# MOVE
expression_5 = Expression(x=len, Expression="Format(\"{0:0.00}\", x*100)")
boolean_toggle_2 = BooleanToggle(True)
integer_13 = Integer(expression_4)
integer_14 = Integer(expression_5)
ghpython_script_3 = GhPythonScript(x=flatten(integer_14), big=boolean_toggle_2)  # -> out, a, b; same code as ghpython_script
ghpython_script_4 = GhPythonScript(x=flatten(integer_13), big=boolean_toggle_2)  # -> out, a, b; same code as ghpython_script

list_length_3 = ListLength(List=flatten(integer_13))
repeat_data_2 = RepeatData(Data=integer_7, Length=list_length_3)
# Format("sender(0x09,0x10,0x00,0xc8,0x00,0x04,0x08,0x00,{0},{1},{2},{3}),move,x,speed,y)
# 
# Format("sender(0x09,0x10,0x00,0xc8,0x00,0x05,0x0a,0x00,{0},{1},{2},{3}),move,x,speed,y)
ghpython_script_5 = GhPythonScript(x=flatten(repeat_data_2), big=boolean_toggle_2)  # -> out, a, b; same code as ghpython_script

modbus_formatter = Expression(
    moveBig=flatten(ghpython_script_3.a),
    moveLittle=flatten(ghpython_script_3.b),
    speedBig=flatten(ghpython_script_4.a),
    speedLittle=ghpython_script_4.b,
    dir=ghpython_script_5.b,
    Expression="Format(\"sender(0x09,0x10,0x00,0xc8,0x00,0x05,0x0a,0x00,{0},{1},{2},{3},{4})\", moveBig,moveLittle,speedBig,speedLittle,dir)")

ghpython_script_6 = GhPythonScript(x=repeat_data, big=boolean_toggle_2)  # -> out, a, b; inputs x: Int32
# ---------- ghpython_script_6: Python ----------
__author__ = "morr0289"
__version__ = "2023.07.05"

import rhinoscriptsyntax as rs
import math


z = int (x * 100)
h = str(hex(x))
s = h.lstrip("0x")
e = s.zfill(4)
if big:
    f = e[0]
    g = e[1]
    h = e[2]
    i = e[3]
else:
    f = e[2]
    g = e[3]
    h = e[0]
    i = e[1]
j = "0x"
k = ","
a = j+f+g
b = j+h+i
# ---------- end ghpython_script_6 ----------
modbus_formatter_2 = Expression(
    moveBig=flatten(ghpython_script.a),
    moveLittle=flatten(ghpython_script.b),
    speedBig=flatten(ghpython_script_2.a),
    speedLittle=ghpython_script_2.b,
    dir=ghpython_script_6.b,
    Expression="Format(\"sender(0x09,0x10,0x00,0xc8,0x00,0x05,0x0a,0x00,{0},{1},{2},{3},{4})\", moveBig,moveLittle,speedBig,speedLittle,dir)")
merge_4 = Merge(Data1=merge, Data2=modbus_formatter, Data5=robot_footer)  # -> flatten(Result)
panel = Panel(merge_4)
