# Grasshopper definition PYgeneratorV1.gh (Grasshopper 1.0.7)
# plug-ins: ShapeDiverForGrasshopper

# ----
# EXTRUSION MULTIPLIER
# Configuration recipe
# 
# Index 1: distance to print plate center
# Index 3: Layer Height
extrusion_multiplier = Slider(1.75, range=0..5)

# ----
# CHOOSE EQUIPMENT
value_list = ValueList({"Potterbot": 200, "Xarm6": 300}, selected="Xarm6")
_200 = Integer(value_list)

# ---- group: make 3 curves
# MAKE 3 CURVES
radius_1 = Slider(93, range=20..200)
plane = Plane(PlaneXY(0, 0, 0))
half_height = Slider(35, range=20..200)
curve_height = Slider(25, range=20..200)
ellipse = Ellipse(Plane=plane, Radius1=radius_1, Radius2=Slider(57, range=20..200))  # -> Ellipse, Focus1, Focus2
vec = VectorXYZ(XComponent=Slider(0.154, range=0..1), YComponent=Slider(0, range=0..1), ZComponent=half_height)  # -> Vector, Length
_3 = Integer(3)
arrlinear = LinearArray(Geometry=ellipse.Ellipse, Direction=vec.Vector, Count=_3)  # -> Geometry, Transform
_4 = Integer(4)
integer = Integer([0, 2])
vec_2 = VectorXYZ(XComponent=Slider(0, range=0..1), YComponent=Slider(0, range=0..1), ZComponent=curve_height)  # -> Vector, Length
cull_i = CullIndex(List=arrlinear.Geometry, Indices=integer, Wrap=True)
divide = DivideCurve(Curve=cull_i, Count=_4, Kinks=False)  # -> Points, Tangents, Parameters
integer_2 = Integer([0, 2])
integer_3 = Integer([1, 3])
cull_i_2 = CullIndex(List=divide.Points, Indices=integer_3, Wrap=True)
cull_i_3 = CullIndex(List=divide.Points, Indices=integer_2, Wrap=True)
move = Move(Geometry=cull_i_3, Motion=vec_2.Vector)  # -> Geometry, Transform
integer_4 = Integer(-2)
division = Division(A=curve_height, B=integer_4)
weave = Weave(Pattern=[0, 1], Stream0=cull_i_2, Stream1=move.Geometry, NullGaps=False)
integer_5 = Integer([0, 1])
integer_6 = Integer([1, 2])
Z = UnitZ(Factor=division)
cull_i_4 = CullIndex(List=arrlinear.Geometry, Indices=integer_5, Wrap=True)
cull_i_5 = CullIndex(List=arrlinear.Geometry, Indices=integer_6, Wrap=True)
intcrv = Interpolate(Vertices=weave, Degree=3, Periodic=True, KnotStyle=1)  # -> Curve, Length, Domain
move_2 = Move(Geometry=intcrv.Curve, Motion=Z)  # -> Geometry, Transform
weave_2 = Weave(Pattern=[0, 1], Stream0=move_2.Geometry, Stream1=cull_i_5, NullGaps=False)
weave_3 = Weave(Pattern=[0, 1], Stream0=cull_i_4, Stream1=move_2.Geometry, NullGaps=False)

# ----
# BASE LAYER HEIGHT
num = Number(1.6)

xarm_config = Panel("""xArm Configuration
300
Layer Height:
1.6""")
potterbot_config = Panel("""Potterbot Configuration
250
Layer Height:
1.6""")
pick_n_choose = PickNChoose(Pattern=value_list, Stream0=xarm_config, Stream1=potterbot_config)
sddb = ShapeDiverDatabase({AbsoluteTolerance=0, AngleTolerance=0, AppDescription="", AppName="dbl_iso_based_PY2", DocumentName="dbl_iso_based_PY2*", InputGroups="{}", OutputGroups="{\"5f137f3f-7b3f-4e17-becb-d69b9a71ffec\":{\"name\":\"ShapeDiver Output\",\"guid\":\"5f137f3f-7b3f-4e17-becb-d69b9a71ffec\",\"index\":0,\"params\":[],\"indexFloor\":0,\"indexCeiling\":-1}}", RelativeTolerance=0, UnitSystem=0})
addition = Addition(A=num, B=num)
line = Line(StartPoint=ellipse.Focus1, EndPoint=ellipse.Focus2)
curve_middle = CurveMiddle(Curve=line)
value_list_2 = ValueList({"GO": 0, "STOP": 1}, selected="GO")
stream_gate = StreamGate(Stream=extrusion_multiplier, Gate=value_list_2)  # -> Target0, Target1
stream_gate_2 = StreamGate(Stream=_200, Gate=value_list_2)  # -> Target0, Target1
stream_gate_3 = StreamGate(Stream=curve_middle, Gate=value_list_2)  # -> Target0, Target1
value_list_3 = ValueList({"GO": 0, "STOP": 1}, selected="GO")

# ----
# NUMBER OF POINTS
curve_points = Slider(100, range=20..200)

# ----
# MOVEMENT SPEED
extrusion_speed = Number(200)

# ----
# BASE POINTS TO MOVE COMMANDS
number = Number(extrusion_speed)

extrusion_width = Slider(2.55, range=1..5)
unit_z = UnitZ(Factor=num)
division_2 = Division(A=extrusion_width, B=-2)
offset_curve = OffsetCurve(Curve=ellipse.Ellipse, Distance=division_2, Corners=1)
area = Area(Geometry=offset_curve)  # -> Area, Centroid
crv_cp = CurveClosestPoint(Point=area.Centroid, Curve=offset_curve)  # -> Point, Parameter, Distance
neg = Negative(Value=extrusion_width)
division_3 = Division(A=crv_cp.Distance, B=extrusion_width)
series = Series(Start=0, Step=neg, Count=division_3)
# BASE
offset = OffsetCurve(Curve=offset_curve, Distance=series, Plane=PlaneXY(0, 0, 0), Corners=2)
_40 = Integer(40)
divide_2 = DivideCurve(Curve=offset, Count=_40, Kinks=False)  # -> Points, Tangents, Parameters
flip = FlipMatrix(Data=divide_2.Points)
pline = PolyLine(Vertices=flip, Closed=False)
explode = Explode(Curve=pline, Recursive=True)  # -> Segments, Vertices
end = EndPoints(Curve=explode.Segments)  # -> Start, End
vec2pt = Vector2Pt(PointA=end.Start, PointB=end.End, Unitize=False)  # -> Vector, Length
range = Range(Domain=Domain(0, 1), Steps=expr("X-1", _40))
flip_2 = FlipMatrix(Data=vec2pt.Vector)
multiplication = Multiplication(A=flip_2, B=range)
move_3 = Move(Geometry=divide_2.Points, Motion=multiplication)  # -> flatten(Geometry), Transform
reverse_list = ReverseList(List=move_3.Geometry)
unit_z_2 = UnitZ(Factor=addition)
pline_2 = PolyLine(Vertices=reverse_list, Closed=False)
move_4 = Move(Geometry=pline_2, Motion=unit_z_2)  # -> Geometry, Transform

# ---- group: contour base
X = UnitX(Factor=1)
contour = Contour(Shape=offset_curve, Point=Point(0, 0, 0), Direction=X, Distance=extrusion_width)
dispatch = Dispatch(List=flatten(contour), DispatchPattern=[True, False])  # -> ListA, ListB
list_item = ListItem(List=move_3.Geometry, Index=0, Wrap=True)
flip_3 = FlipCurve(Curve=dispatch.ListB)  # -> Curve, Flag
weave_4 = Weave(Pattern=[0, 1], Stream0=dispatch.ListA, Stream1=flip_3.Curve, NullGaps=False)
disc = Discontinuity(Curve=weave_4, Level=1)  # -> Points, Parameters
closest_point = ClosestPoint(Point=list_item, Cloud=flatten(disc.Points))  # -> ClosestPoint, CPIndex, Distance
shift_list = ShiftList(List=disc.Points, Shift=closest_point.CPIndex, Wrap=True)  # -> flatten(List)
pline_3 = PolyLine(Vertices=shift_list, Closed=False)

# ----
move_5 = Move(Geometry=pline_3, Motion=unit_z)  # -> Geometry, Transform
merge = Merge(Data1=move_5.Geometry, Data2=move_4.Geometry)

stream_gate_4 = StreamGate(Stream=merge, Gate=value_list_2)  # -> Target0, Target1

# ----
# MOVE GEOMETRY TO PRINT PLATE
integer_7 = Integer(0)
vec_3 = VectorXYZ(XComponent=stream_gate_2.Target0, YComponent=stream_gate_2.Target0, ZComponent=integer_7)  # -> Vector, Length
move_up_and_to_cartesian = Move(Geometry=stream_gate_4.Target0, Motion=vec_3.Vector)  # -> Geometry, Transform

# ----
# Extrusion multiplier
stream_gate_5 = StreamGate(Stream=move_up_and_to_cartesian.Geometry, Gate=value_list_3)  # -> Target0, Target1

# ----
# BASE POINTS
explode_2 = Explode(Curve=stream_gate_5.Target0, Recursive=True)  # -> Segments, Vertices
len = Length(Curve=explode_2.Segments)
multiplication_2 = Multiplication(A=len, B=stream_gate.Target0)

# ----
# TOP ISOCURVES
loft = Loft(Curves=weave_3, Options={Adjust=False, Closed=False, LoftEnds=0, LoftSimp=2, LoftType=0, Rebuild=10, Refit=0.01})
bbox_size_of_object = BoundingBox(Content=weave_3, Plane=PlaneXY(0, 0, 0))  # -> Box, Box_2
debox = DeconstructBox(Box=bbox_size_of_object.Box)  # -> Plane, X, Y, Z
dedomain = DeconstructDomain(Domain=debox.Z)  # -> Start, End
cull_i_6 = CullIndex(List=dedomain.End, Indices=1, Wrap=True)

# ---- group: isocurves
# BOTTOM ISOCURVES
loft_2 = Loft(Curves=weave_2, Options={Adjust=False, Closed=False, LoftEnds=0, LoftSimp=2, LoftType=0, Rebuild=10, Refit=0.01})
bbox_size_of_object_2 = BoundingBox(Content=weave_2, Plane=PlaneXY(0, 0, 0))  # -> Box, Box_2
debox_2 = DeconstructBox(Box=bbox_size_of_object_2.Box)  # -> Plane, X, Y, Z
dedomain_2 = DeconstructDomain(Domain=debox_2.Z)  # -> Start, End

# ----
# WALLS
# WALLS LAYER HEIGHT
layer_height = Number(2.15)

# ---- group: isocurves (continued)
division_4 = Division(A=dedomain_2.End, B=layer_height)
range_2 = Range(Domain=Domain(0, 1), Steps=division_4)
pt = ConstructPoint(XCoordinate=range_2, YCoordinate=0, ZCoordinate=0)
iso = IsoCurve(Surface=reparameterize(loft_2), UVPoint=pt)  # -> UIsocurve, flatten(VIsocurve)
rev = ReverseList(List=iso.VIsocurve)

# ----
division_5 = Division(A=cull_i_6, B=layer_height)
range_3 = Range(Domain=Domain(0, 1), Steps=division_5)
pt_2 = ConstructPoint(XCoordinate=range_3, YCoordinate=0, ZCoordinate=0)
iso_2 = IsoCurve(Surface=reparameterize(loft), UVPoint=pt_2)  # -> UIsocurve, flatten(VIsocurve)
rev_2 = ReverseList(List=iso_2.VIsocurve)

merge_2 = Merge(Data1=rev, Data2=rev_2)

stream_gate_6 = StreamGate(Stream=merge_2, Gate=value_list_2)  # -> Target0, Target1

# ----
# MOVE GEOMETRY TO PRINT PLATE
addition_2 = Addition(A=addition, B=layer_height)
vec_4 = VectorXYZ(XComponent=stream_gate_2.Target0, YComponent=stream_gate_2.Target0, ZComponent=addition_2)  # -> Vector, Length
move_up_and_to_cartesian_2 = Move(Geometry=stream_gate_3.Target0, Motion=vec_4.Vector)  # -> Geometry, Transform

# ----
# MOVE GEOMETRY TO PRINT PLATE
addition_3 = Addition(A=addition, B=layer_height)
vec_5 = VectorXYZ(XComponent=stream_gate_2.Target0, YComponent=stream_gate_2.Target0, ZComponent=addition_3)  # -> Vector, Length
move_up_and_to_cartesian_3 = Move(Geometry=stream_gate_6.Target0, Motion=vec_5.Vector)  # -> Geometry, Transform

stream_gate_7 = StreamGate(Stream=move_up_and_to_cartesian_3.Geometry, Gate=value_list_3)  # -> Target0, Target1
stream_gate_8 = StreamGate(Stream=move_up_and_to_cartesian_2.Geometry, Gate=value_list_3)  # -> Target0, Target1

# ----
# CALCULATE PITCH YAW ROLL
list_length = ListLength(List=stream_gate_7.Target0)
multiplication_3 = Multiplication(A=list_length, B=curve_points)
deconstruct = Deconstruct(Point=stream_gate_8.Target0)  # -> XComponent, YComponent, ZComponent
subtraction = Subtraction(A=multiplication_3, B=curve_points)
series_2 = Series(Start=0, Step=1, Count=curve_points)
series_3 = Series(Start=subtraction, Step=1, Count=curve_points)
# xArm6 PYTHON GENERATOR
addition_4 = Addition(A=deconstruct.ZComponent, B=10)
construct_point = ConstructPoint(XCoordinate=deconstruct.XComponent, YCoordinate=deconstruct.YComponent, ZCoordinate=addition_4)
vector_2pt = Vector2Pt(PointA=construct_point, PointB=stream_gate_8.Target0, Unitize=False)  # -> Vector, Length
integer_8 = Integer(0)

# ----
# MOVEMENT
divide_3 = DivideCurve(Curve=stream_gate_7.Target0, Count=curve_points, Kinks=False)  # -> Points, Tangents, Parameters
deconstruct_2 = Deconstruct(Point=divide_3.Points)  # -> XComponent, YComponent, ZComponent

# ----
# SEGMENT LENGTH
shift_list_2 = ShiftList(List=divide_3.Points, Shift=1, Wrap=True)
length_of_segment = Distance(PointA=divide_3.Points, PointB=shift_list_2)  # -> flatten(SegmentLength)
segment_length = Expression(x=length_of_segment, Expression="Format(\"{0:0.00}\",x)")

# ----
# EXTRUSION SPEED MULTIPLIER
flip_4 = FlipMatrix(Data=divide_3.Points)
shift_list_3 = ShiftList(List=flip_4, Shift=1, Wrap=False)
line_2 = Line(StartPoint=flip_4, EndPoint=shift_list_3)  # -> simplify(Line)
flip_5 = FlipMatrix(Data=line_2)
length = Length(Curve=flip_5)  # -> flatten(Length)
multiplication_4 = Multiplication(A=segment_length, B=length, C=Slider(1, range=0.1..3))

list_item_2 = ListItem(List=flatten(divide_3.Points), Index=series_3, Wrap=True)
list_item_3 = ListItem(List=flatten(divide_3.Points), Index=series_2, Wrap=True)
vector_2pt_2 = Vector2Pt(PointA=list_item_3, PointB=list_item_2, Unitize=False)  # -> Vector, Length
angle = Angle(VectorA=vector_2pt_2.Vector, VectorB=vector_2pt.Vector)  # -> Angle, Reflex
degrees = Degrees(Radians=angle.Angle)

# ----
# EXTRUSION
expression = Expression(x=multiplication_4, Expression="Format(\"{0:0.00}\", x*100)")
multiplication_5 = Multiplication(A=segment_length, B=100)
integer_9 = Integer(multiplication_5)
integer_10 = Integer(expression)
integer_11 = Integer(9)
gcode_formatter = Expression(port=integer_11, move=integer_9, speed=integer_10, Expression="Format(\"sender({0},{1},{2})\", port, move, speed)")

gcode_formatter_2 = Expression(
    e=extrusion_speed,
    x=deconstruct_2.XComponent,
    y=deconstruct_2.YComponent,
    z=deconstruct_2.ZComponent,
    pitch=integer_8,
    yaw=integer_8,
    roll=degrees,
    Expression="Format(\"arm.set_position(x={0:0.00}, y={1:0.00}, z={2:0.00}, roll={3:0.00}, pitch={4:0.00}, yaw={5:0.00}, speed={6:0.00}, is_radian=False, wait=True)\", x, y, z, roll, pitch, yaw, e)")  # -> flatten(Result)
weave_5 = Weave(Pattern=[0, 1], Stream0=gcode_formatter_2, Stream1=gcode_formatter, NullGaps=False)

deconstruct_3 = Deconstruct(Point=explode_2.Vertices)  # -> XComponent, YComponent, ZComponent
gcode_formatter_3 = Expression(
    e=number,
    x=deconstruct_3.XComponent,
    y=deconstruct_3.YComponent,
    z=deconstruct_3.ZComponent,
    pitch=integer_8,
    yaw=integer_8,
    roll=degrees,
    Expression="Format(\"arm.set_position(x={0:0.00}, y={1:0.00}, z={2:0.00}, roll={3:0.00}, pitch={4:0.00}, yaw={5:0.00}, speed={6:0.00}, is_radian=False, wait=True)\", x, y, z, roll, pitch, yaw, e)")  # -> flatten(Result)
base_2_code = Panel(gcode_formatter_3)

expression_2 = Expression(x=len, Expression="Format(\"{0:0.00}\", x*100)")
expression_3 = Expression(x=multiplication_2, Expression="Format(\"{0:0.00}\", x*100)")
integer_12 = Integer(9)
integer_13 = Integer(expression_3)
integer_14 = Integer(expression_2)
expression_4 = Expression(x="192.168.1.196", Expression="Format(\"arm = XArmAPI('{0}', is_radian=False, do_not_open=False)\", x)")
modbus_formatter = Expression(
    port=integer_12,
    move=flatten(integer_14),
    speed=flatten(integer_13),
    Expression="Format(\"sender({0}, {1}, {2})\", port, move, speed)")
header3 = Panel("""def sender(port,length,speed):
    hport = hex(port)
    hlength = hex(length)
    bytelength = makebytes(length)
    hspeed = hex(speed)
    bytespeed = makebytes(speed)
    code, ret = arm.getset_tgpio_modbus_data([hport,0x10,0x00,0xc8,0x00,0x04,0x08,0x00,bytelength,bytespeed],is_transparent_transmission=True)

#def bytes(integer):
    #return divmod(integer, 0x100)

def makebytes(num):
    return hex(num >> 8), hex(num & 0xFF)

#def makebytes(num):
    #split = ("0x%2x 0x%2x\n" % tuple(struct.pack('<H',num)))# a bytes object
    #return split

arm.motion_enable(enable=True)
arm.set_mode(0)

port = 9
arm.set_state(state=0)

arm.reset(wait=True)""")
_1001_move_line_py = Panel("""#code generated with Grasshopper for Rhino at the University of Oklahoma, 
#Gibbs College of Architecture, in the Creating_Making Lab.
#Chris Morrey 9/2023

import math
import os
import struct
import sys
import time

sys.path.append("C:\\Users\\morr0289\\Documents\\Github\\RobotArm\\Python\\")

from arm_sdk2.xarm.wrapper.xarm_api import XArmAPI""")
robot_footer = Panel("""arm.reset(wait=True)
arm.disconnect()""")
merge_3 = Merge(Data1=_1001_move_line_py, Data2=expression_4, Data3=header3)
weave_6 = Weave(Pattern=[1, 0], Stream0=modbus_formatter, Stream1=base_2_code, NullGaps=False)
merge_4 = Merge(Data1=merge_3, Data3=weave_6, Data4=weave_5, Data5=robot_footer)  # -> flatten(Result)
panel = Panel(merge_4)
