# Grasshopper definition isocurvecustom.gh (Grasshopper 1.0.7)

layer_height = Number(2.15)

# ---- group: isocurves
crv_top_curve_first = Curve([<curve referenced from the Rhino model> x2])
loft = Loft(
    Curves=crv_top_curve_first,
    Options={Adjust=False, Closed=False, LoftEnds=0, LoftSimp=0, LoftType=0, Rebuild=10, Refit=0.01})
bbox_size_of_object = BoundingBox(Content=crv_top_curve_first, Plane=PlaneXY(0, 0, 0))  # -> Box, Box_2
debox = DeconstructBox(Box=bbox_size_of_object.Box)  # -> Plane, X, Y, Z
dedomain = DeconstructDomain(Domain=debox.Z)  # -> Start, End
division = Division(A=dedomain.End, B=layer_height)
range = Range(Domain=Domain(0, 1), Steps=division)
pt = ConstructPoint(XCoordinate=range, YCoordinate=0, ZCoordinate=0)
iso = IsoCurve(Surface=reparameterize(loft), UVPoint=pt)  # -> UIsocurve, flatten(VIsocurve)
rev = ReverseList(List=iso.VIsocurve)

# ----
vector_xyz = VectorXYZ(XComponent=200, YComponent=200, ZComponent=50)  # -> Vector, Length
move_up_and_to_cartesian = Move(Geometry=rev, Motion=vector_xyz.Vector)  # -> Geometry, Transform
points = Slider(100, range=20..200)
divide = DivideCurve(Curve=move_up_and_to_cartesian.Geometry, Count=points, Kinks=False)  # -> Points, flatten(Tangents), Parameters

# ---- group: Compute E
flip = FlipMatrix(Data=divide.Points)
explode = Explode(Curve=move_up_and_to_cartesian.Geometry, Recursive=True)  # -> Segments, Vertices
pline = PolyLine(Vertices=flip, Closed=False)
end = EndPoints(Curve=pline)  # -> Start, End
vec2pt = Vector2Pt(PointA=end.Start, PointB=end.End, Unitize=False)  # -> Vector, Length
flip_2 = FlipMatrix(Data=vec2pt.Vector)
len = Length(Curve=explode.Segments)
vlen = VectorLength(Vector=flip_2)
extrude_factor = Slider(0.51, range=0.1..2)
cull_i = CullIndex(List=flatten(vlen), Indices=1, Wrap=True)
_3 = Integer(3)
bnd = Bounds(Numbers=cull_i)
division_2 = Division(A=len, B=_3)
remap = RemapNumbers(Value=cull_i, Source=bnd, Target=extrude_factor)  # -> Mapped, Clipped
multiplication = Multiplication(A=division_2, B=remap.Mapped)
ma = MassAddition(Input=multiplication)  # -> Result, PartialResults

# ----
panel = Panel(ma.PartialResults)
integer = Integer(1000)

# ---- group: Gcode
deconstruct = Deconstruct(Point=divide.Points)  # -> XComponent, YComponent, ZComponent
gcode_formatter = Expression(
    e=ma.PartialResults,
    x=deconstruct.XComponent,
    y=deconstruct.YComponent,
    f=integer,
    z=deconstruct.ZComponent,
    Expression="Format(\"G1 X{0:0.00} Y{1:0.00} Z{2:0.00} F{3:0.00} E{4:0.00}\", x, y, z, f, e)")  # -> flatten(Result)
potterbot_header = Panel("""M105
M109 S0
M82 ;absolute extrusion mode
G28 ;Home
G1 X207.5 Y202.5 Z20 F10000 ;Move X and Y to center, Z to 20mm high
G92 E0
G1 E4000 F40000 ; Prime Extruder
G92 E0""")
potterbot_footer = Panel("""M83 ;Set to Relative Extrusion Mode
G91 ;Set to Relative Positioning
G1 Z150 E-4000 F66666 ;Move Z Axis up and depressurize Extruder slightly
G90 ;Set to Absolute Positioning
G28 Z ;Home Z
G1 X0 Y0 F500 ;Move X and Y slow to home position
M82 ;absolute extrusion mode
;End of Gcode""")
object_code = Panel(gcode_formatter)
merge = Merge(Data1=potterbot_header, Data2=object_code, Data3=potterbot_footer)  # -> flatten(Result)
panel_2 = Panel(merge)
