# Grasshopper definition xarm6 robot.gh (Grasshopper 1.0.7)
# plug-ins: Robot Components

panel = Panel("""0
-118
-225
0
-97
0""")
panel_2 = Panel("""360
120
11
360
180
360""")
construct_domain = ConstructDomain(DomainStart=panel, DomainEnd=panel_2)
plane = Plane([PlaneXY(-1.046653446e-12, 0, 153.8), Plane(origin=(0.002463142479, 75.49504316, 266.1194075), x=(1, 0, 0), y=(0, -2.738987685e-07, 1)), Plane(origin=(53.32137883, 67.63063588, 551.001277), x=(0.9999989033, 0.001480992889, 5.584489548e-09), y=(0, -3.770710321e-06, 1)), PlaneXY(131.1013897, 0.1987584925, 381.5789311), Plane(origin=(131.1712078, -4.55521799, 208.5832124), x=(-1, 0, 0), y=(0, 1.864714284e-07, 1)), PlaneXY(207.1497174, 0, 140.0582698)])
xy_plane = XYPlane(Origin=Point(0, 0, 0))
mesh = Mesh([<mesh referenced from the Rhino model> x7])
robot_joint_position = RobotJointPosition(
    RobotJointPosition1=Slider(0, range=0..360),
    RobotJointPosition2=Slider(0, range=-118..120),
    RobotJointPosition3=Slider(0, range=-225..11),
    RobotJointPosition4=Slider(0, range=0..360),
    RobotJointPosition5=Slider(0, range=-97..180),
    RobotJointPosition6=Slider(0, range=0..360))
robot = Robot(
    Name="xArm 6",
    Meshes=mesh,
    AxisPlanes=plane,
    AxisLimits=construct_domain,
    PositionPlane=xy_plane,
    MountingFrame=xy_plane)
robot_tool = RobotTool(
    Name="tool1",
    AttachmentPlane=PlaneXY(0, 0, 0),
    ToolPlane=PlaneXY(0, 0, 0),
    Set_Center_of_Gravity=False,
    Set_Mass=False,
    Set_Moment_of_Inertia=False)
